# Grasshopper definition AgentSystem.gh (Grasshopper 1.0.7)
# Copyright: Co-de-iT
# plug-ins: ScriptParasite, froGH, Human

number_slider = Slider(2000, range=50..2000)
box = DomainBox(Base=PlaneXY(0, 0, 0), X="-1 to 1", Y="-1 to 1", Z="-1 to 1")
rectangle = Rectangle(Plane=PlaneXY(0, 0, 0), XSize="30", YSize="30", Radius=0)  # -> Rectangle, Length
box_2 = DomainBox(Base=PlaneXY(0, 0, 0), X="30", Y="30", Z="30")
rectangle_2 = Rectangle(Plane=PlaneXY(0, 0, 0), XSize="-1 to 1", YSize="-1 to 1", Radius=0)  # -> Rectangle, Length
pop3d = Populate3D(Region=box_2, Count=number_slider, Seed=1)
pop2d = Populate2D(Region=rectangle_2.Rectangle, Count=number_slider, Seed="2")
pop3d_2 = Populate3D(Region=box, Count=number_slider, Seed="2")
pop2d_2 = Populate2D(Region=rectangle.Rectangle, Count=number_slider, Seed=1)
# Agent System
# 
# An Agent System that can follow Reynolds' rules or interact via stigmergy
# 
# code by Alessio Erioli - adapted and extended over a code by Long Nguyen for ICD
# 
# v 0.1
# © a3 2023 / Creative Commons Attribution-Non Commercial-ShareAlike 4.0 International License
previewlw = CustomPreviewLineweights(Geometry=rectangle.Rectangle, Shader=ColourSwatch(SwatchColor=RGB(196, 196, 196)), Absolute=False)
unit = UnitVector(Vector=pop3d_2)
unit_2 = UnitVector(Vector=pop2d)
list = ValueList({"2D": 0, "3D": 1}, selected="2D")
filter = StreamFilter(Gate=list, Stream0=pop2d_2, Stream1=pop3d)
filter_2 = StreamFilter(Gate=list, Stream0=unit_2, Stream1=unit)
list_2 = ValueList({"sequential/boids": 0, "parallel/stigmergy": 1, "RTree/boids": 2}, selected="parallel/stigmergy")
number_slider_2 = Slider(1.5, range=0..10)
reset = Button()
go = BooleanToggle(False)
f_ghfilepath = GHFilePathInfo()  # -> FileName, FilePath
concat = Concatenate(FragmentA=f_ghfilepath.FilePath, FragmentB="scripts")
multiplication = Multiplication(A=number_slider_2, B=Slider(0.3, range=0..1))

agentsystem = CSharpScript(
    reset=reset,
    go=go,
    uT=list_2,
    P=filter,
    V=filter_2,
    nR=number_slider_2,
    aoV=Slider(80, range=0..180),
    coS=Slider(0.154, range=0..10),
    alS=Slider(9, range=0..10),
    seS=Slider(2.5, range=0..10),
    seR=multiplication,
    Reference="C:\Users\aless\AppData\Roaming\Grasshopper\Libraries\Plankton.dll")  # -> out, oP, oV, oT; inputs reset: Boolean, go: Boolean, uT: Int32, P: list of Point3d, V: list of Vector3d, nR: Double, aoV: Double, coS: Double, alS: Double, seS: Double, seR: Double
# ---------- agentsystem: C# usings ----------
using System.Threading.Tasks;
using Plankton;
# ---------- agentsystem: C# ----------
    // initialize
    if (agSys == null || reset)
      agSys = new AgentSystem(P, V);

    // update
    if (go)
    {
      // update live variables
      agSys.NeighborhoodRadius = nR;
      agSys.CohesionStrength = coS;
      agSys.AlignmentStrength = alS;
      agSys.SeparationStrength = seS;
      agSys.SeparationRadius = seR;
      agSys.AngleOfVision = ToRadians(aoV);

      // simulation update
      switch (uT)
      {
        case 0:
          agSys.Update();
          break;
        case 1:
          agSys.UpdateParallel();
          break;
        case 2: // RTree
          agSys.UpdateRTree();
          break;
        default:
          goto case 2;
      }

      Component.ExpireSolution(true);
    }
    // output
    //outPos = new List<Point3d>();
    //outVel = new List<Vector3d>();
    //outTrails = new List<Polyline>();

    //foreach (Agent agent in agSys.agents)
    //{
    //  outPos.Add(agent.position);
    //  outVel.Add(agent.velocity);
    //  outTrails.Add(agent.trail);
    //}

    agSys.Output();

    oP = agSys.outputValues.positions; //outPos;
    oV = agSys.outputValues.velocities;//outVel;
    oT = agSys.outputValues.trails; //outTrails;
# ---------- agentsystem: C# additional code ----------
  // global variables
  public AgentSystem agSys;
  //public List<Point3d> outPos;
  //public List<Vector3d> outVel;
  //public List<Polyline> outTrails;

  // custom classes
  public class AgentSystem
  {
    // fields
    public List<Agent> agents;
    public double NeighborhoodRadius;
    public double CohesionStrength;
    public double AlignmentStrength;
    public double SeparationStrength;
    public double SeparationRadius;
    public double BoundingBoxSize;
    public double ContainmentStrength;
    public double MaxSpeed;
    public double AngleOfVision;
    public int iterationCount;
    public OutputValues outputValues;

    // constructor(s)
    public AgentSystem(List<Point3d> points, List<Vector3d> vectors)
    {
      agents = new List<Agent>();

      for (int i = 0; i < points.Count; i++)
      {
        Agent ag = new Agent(points[i], vectors[i]);
        ag.agentSystem = this;
        agents.Add(ag);
      }

      iterationCount = 0;
      BoundingBoxSize = 30.0;
      ContainmentStrength = 1.0;
      MaxSpeed = 0.3;
    }

    // methods
    public void UpdateRTree()
    {
      // build RTree
      RTree PointsRTree = new RTree();
      for (int i = 0; i < agents.Count; i++)
        PointsRTree.Insert(agents[i].position, i);

      // find neighbours & call compute
      foreach (Agent agent in agents)
      {
        List<Agent> neighbours = new List<Agent>();

        PointsRTree.Search(new Sphere(agent.position, NeighborhoodRadius), (sender, args) =>
        {
          if (agents[args.Id] != agent)
          {
            Vector3d toNeighbour = agents[args.Id].position - agent.position;

            if (Vector3d.VectorAngle(toNeighbour, agent.velocity) < AngleOfVision)
              neighbours.Add(agents[args.Id]);
          }
        });

        agent.ComputeFlocking(neighbours);
      }

      // update velocity and position
      Parallel.ForEach(agents, agent =>
      {
        agent.UpdateVelocityAndPosition();
      });

      iterationCount++;

    }

    public void UpdateParallel()
    {
      // compute
      Parallel.ForEach(agents, agent =>
      {
        agent.ComputeStigmergy();
      });

      //foreach (Agent agent in agents)
      //{
      //  //List<Agent> neighbours = FindNeighbours(agent);
      //  //agent.Compute(neighbours);
      //  agent.Compute(FindNeighbours(agent));
      //}

      // update velocity & position
      //foreach (Agent agent in agents)
      Parallel.ForEach(agents, agent =>
      {
        agent.UpdateVelocityAndPosition();
      });

      iterationCount++;
    }

    public void Update()
    {
      // compute
      foreach (Agent agent in agents)
      {
        //List<Agent> neighbours = FindNeighbours(agent);
        //agent.Compute(neighbours);
        agent.ComputeFlocking(FindNeighbours(agent));
      }

      // update velocity & position
      foreach (Agent agent in agents)
        agent.UpdateVelocityAndPosition();

      iterationCount++;
    }

    public List<Agent> FindNeighbours(Agent ag)
    {
      List<Agent> neighbours = new List<Agent>();
      foreach (Agent neighbour in agents)
      {
        if (neighbour != ag && ag.position.DistanceTo(neighbour.position) < NeighborhoodRadius)
        {
          neighbours.Add(neighbour);
        }
      }

      return neighbours;
    }

    public void Output()
    {
      outputValues = new OutputValues(agents.Count);

      // for(int i=0; i< agents.Count; i++)
      Parallel.For(0, agents.Count, i =>
      {
        outputValues.positions[i] = new GH_Point(agents[i].position);
        outputValues.velocities[i] = new GH_Vector(agents[i].velocity);
        outputValues.trails[i] = agents[i].trail;
      });

    }

  }

  public struct OutputValues
  {
    public GH_Point[] positions;
    public GH_Vector[] velocities;
    public Polyline[] trails;

    public OutputValues(int agentsCount)
    {
      positions = new GH_Point[agentsCount];
      velocities = new GH_Vector[agentsCount];
      trails = new Polyline[agentsCount];
    }
  }

  public class Agent
  {
    // fields
    public Point3d position;
    public Vector3d velocity;
    public Vector3d desired;
    public Polyline trail;
    public int trailLength;
    public AgentSystem agentSystem;

    // constructor(s)
    public Agent(Point3d position, Vector3d velocity)
    {
      this.position = position;
      this.velocity = velocity;
      trail = new Polyline(new Point3d[] { this.position });
      trailLength = 10;
      //double[] values = new double[3];
      //values[2] = 1.5;
    }

    // methods

    public void ComputeFlocking(List<Agent> neighbours)
    {
      ResetDesired();
      Containment();
      Flocking(neighbours);
    }

    public void ComputeStigmergy()
    {
      ResetDesired();
      Containment();
      SeekTarget(FindClosestTrailPoint(), 10.0);
    }

    public void SeekTarget(Point3d target, double intensity)
    {
      Vector3d seek = target - position;

      desired += seek * intensity;
    }

    public Point3d FindClosestTrailPoint()
    {
      Point3d trailPoint, closest = position;
      double dist, minDist = agentSystem.NeighborhoodRadius;
      int value, maxValue = -1;

      foreach (Agent other in agentSystem.agents)
      {
        if (other == this) continue;

        value = other.trail.ClosestIndex(position + velocity * 3.0);
        trailPoint = other.trail[value];
        //trailPoint = other.trail.ClosestPoint(position + velocity * 3.0);
        Vector3d toTrailPoint = trailPoint - position;
        dist = toTrailPoint.Length;
        if (dist < minDist && Vector3d.VectorAngle(toTrailPoint, velocity) < agentSystem.AngleOfVision)
          if (value > maxValue)
          {
            closest = trailPoint;
            minDist = dist;
            maxValue = value;
          }
      }

      return closest;
    }

    public void Flocking(List<Agent> neighbours)
    {
      if (neighbours.Count == 0) return;

      // . . . . . cohesion

      // find neighbours average
      Point3d average = new Point3d();

      foreach (Agent neighbour in neighbours)
        average += neighbour.position;

      average /= neighbours.Count;

      // go there
      Vector3d cohesion = average - position;

      // update desired
      desired += cohesion * agentSystem.CohesionStrength;

      // . . . . . alignment
      Vector3d alignment = Vector3d.Zero;

      foreach (Agent neighbour in neighbours)
        alignment += neighbour.velocity;

      alignment /= neighbours.Count;

      desired += alignment * agentSystem.AlignmentStrength;
      // . . . . . separation
      Vector3d separation = Vector3d.Zero;

      foreach (Agent neighbour in neighbours)
      {
        // check if in separation radius
        double distanceToNeighbour = position.DistanceTo(neighbour.position);
        if (distanceToNeighbour < agentSystem.SeparationRadius)
        {
          Vector3d getaway = position - neighbour.position;
          getaway /= (getaway.Length * distanceToNeighbour);
          separation += getaway;
        }
      }

      desired += separation * agentSystem.SeparationStrength;
    }

    public void ResetDesired()
    {
      desired = velocity;
    }

    public void Containment()
    {
      if (position.X < 0.0)
        desired += new Vector3d(-position.X, 0, 0);
      else if (position.X > agentSystem.BoundingBoxSize)
        desired += new Vector3d(agentSystem.BoundingBoxSize - position.X, 0, 0);

      if (position.Y < 0.0)
        desired += new Vector3d(0, -position.Y, 0);
      else if (position.Y > agentSystem.BoundingBoxSize)
        desired += new Vector3d(0, agentSystem.BoundingBoxSize - position.Y, 0);

      if (position.Z < 0.0)
        desired += new Vector3d(0, 0, -position.Z);
      else if (position.Z > agentSystem.BoundingBoxSize)
        desired += new Vector3d(0, 0, agentSystem.BoundingBoxSize - position.Z);
    }
    public void UpdateVelocityAndPosition()
    {
      // steering
      velocity = 0.97 * velocity + 0.03 * desired;

      if (velocity.Length > agentSystem.MaxSpeed)
      {
        velocity.Unitize();
        velocity *= agentSystem.MaxSpeed;
      }

      // update position
      position += velocity;

      // update trail
      if (agentSystem.iterationCount % 4 == 0)
        trail.Add(position);

      if (trail.Count > trailLength)
        trail.RemoveAt(0);

    }
  }

  public double ToRadians(double degrees)
  {
    return degrees * Math.PI / 180.0;
  }
# ---------- end agentsystem ----------
scriptpar = ScriptParasite(Enable=Toggle(False), Folder=concat)

vdisex = VectorDisplayEx(Point=agentsystem.oP, Vector=agentsystem.oV, Colour=RGB(0, 0, 0), Width=2)
thickness = Slider(0.08, range=0..1)

mesh_polylines = CSharpScript(P=agentsystem.oT, t=thickness)  # -> out, M; inputs P: list of Polyline, t: Double
# ---------- mesh_polylines: C# usings ----------
using System.Threading.Tasks;
# ---------- mesh_polylines: C# ----------
    GH_Mesh[] meshes = new GH_Mesh[P.Count];

    //for (int i=0; i< P.Count; i++) 
    Parallel.For(0, P.Count, i =>
    {
      // if your loop is parallel all extra variables used inside the loop 
      // should be locally declared
      Mesh m, mPoly = new Mesh();
      Line[] segments = P[i].GetSegments();
      Point3d a, b, c, d;

      foreach (Line line in segments)
      {
        Vector3d offsetdir = Vector3d.CrossProduct(line.Direction, Vector3d.ZAxis);
        offsetdir.Unitize();
        offsetdir *= t * 0.5;
        a = line.From + offsetdir;
        b = line.To + offsetdir;
        c = line.To - offsetdir;
        d = line.From - offsetdir;
        m = new Mesh();
        m.Vertices.AddVertices(new[] { a, b, c, d });
        m.Faces.AddFace(0, 1, 2, 3);
        m.RebuildNormals();
        mPoly.Append(m);
      }
      meshes[i] = new GH_Mesh(mPoly);
    });

    M = meshes;
# ---------- end mesh_polylines ----------
scriptpar_2 = ScriptParasite(Enable=Toggle(False), Folder=concat)

material = CreateMaterial(
    Diffuse=ColourSwatch(SwatchColor=RGB(223, 138, 235)),
    Specular=RGB(255, 255, 255),
    Emission=RGB(0, 0, 0),
    Transparency=Slider(0.85, range=0..1),
    Shine=0)
preview = CustomPreview(Geometry=mesh_polylines.M, Material=material)
