# Grasshopper definition day01_01_counters.gh (Grasshopper 1.0.7)
# Copyright: Co-de-iT

reset = BooleanToggle(False)
go = BooleanToggle(False)
reset_2 = BooleanToggle(False)
trigger = Trigger(Interval=1, TimerInterval=5, Target=countertrigger)  # disabled
# trigger
countertrigger = CSharpScript(reset=reset_2)  # -> out, A; inputs reset: Boolean
# ---------- countertrigger: C# ----------
    if (reset)
      i = 0;
    else
      i = i + 1;
    
    A = i;
# ---------- countertrigger: C# additional code ----------
  int i;
# ---------- end countertrigger ----------
# ExpireSolution
counterexpire = CSharpScript(reset=reset, go=go)  # -> out, A; inputs reset: Boolean, go: Boolean
# ---------- counterexpire: C# ----------
    if (reset)
      i = 0;
    else if (go)
    {
      i = i + 1;
      Component.ExpireSolution(true);
    } else
      Print("Press something to make something happen");

    A = i;
# ---------- counterexpire: C# additional code ----------
  int i;
# ---------- end counterexpire ----------
# <title>
# 
# <description>
# 
# code by Alessio Erioli
# 
# v 0.1
# © a3 2021 / Creative Commons Attribution-Non Commercial-ShareAlike 4.0 International License
panel = Panel(countertrigger.A)
panel_2 = Panel(counterexpire.out)
panel_3 = Panel(counterexpire.A)
