# Grasshopper definition day01_02_circuit game.gh (Grasshopper 1.0.7)
# Copyright: Co-de-iT
# plug-ins: Human

# <title>
# 
# <description>
# 
# code by Alessio Erioli
# 
# v 0.1
# © a3 2021 / Creative Commons Attribution-Non Commercial-ShareAlike 4.0 International License
md_slider = MDSlider(
    SliderMode=0,
    slider_value=Point(0.4047903643, 0.6439026623, 0.5),
    x_domain=Domain(-1, 1),
    y_domain=Domain(-1, 1),
    z_domain=Domain(0, 1))
number_slider = Slider(10, range=0..10)
crv = Curve(reparameterize(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))
neg = Negative(Value=number_slider)
merge = Merge(Data1=number_slider, Data2=neg)
speed_limit = Slider(1, range=0..1)
crash_radius = Slider(2.5, range=0..10)
offset = OffsetCurve(Curve=crv, Distance=merge, Corners=1)  # -> flatten(Curve)
eval = EvaluateCurve(Curve=crv, Parameter="0")  # -> Point, Tangent, Angle
go = BooleanToggle(False)
multiplication = Multiplication(A=md_slider, B=speed_limit)
previewlw = CustomPreviewLineweights(Geometry=offset, Shader=ColourSwatch(SwatchColor=RGB(0, 0, 0)), Thickness="5", Absolute=False)
c_script = CSharpScript(reset=Button(), go=go, P=eval.Point, V=multiplication, R=crash_radius, C=offset)  # -> out, A; inputs reset: Boolean, go: Boolean, P: Point3d, V: Vector3d, R: Double, C: list of Curve
# ---------- c_script: C# ----------
    // initialization
    if (reset || pointVehicle == null) // || OR,  && AND,  ! NOT
      pointVehicle = new Vehicle(P, V, R);

    // Update
    if (go)
    {
      if (pointVehicle.Crash(C))
      {
        pointVehicle.position = P;
        Print("CRASH!!!!");
      }

      pointVehicle.velocity = V;
      pointVehicle.Move();
      Component.ExpireSolution(true);
    }

    //Print(Iteration.ToString());

    // Output

    A = pointVehicle.position;
# ---------- c_script: C# additional code ----------
  Vehicle pointVehicle;

  class Vehicle
  {
    // fields
    public Point3d position;
    public Vector3d velocity;
    public double cRadius;

    // constructors
    public Vehicle(Point3d P, Vector3d V, double R)
    {
      position = P;
      velocity = V;
      cRadius = R;
    }
    // methods
    public void Move()
    {
      // position = position + velocity;
      position += velocity;  // -=  *=  /=
    }

    public bool Crash(List<Curve> circuit)
    {
      bool crashed = false;

      foreach(Curve c in circuit)
      {
        double t;
        if (c.ClosestPoint(position, out t))
        {
          if (position.DistanceTo(c.PointAt(t)) < cRadius)
          {
            crashed = true;
            break;
          }
        }
      }

      return crashed;
    }
  }
# ---------- end c_script ----------
panel = Panel(c_script.out)
pl = ConstructPlane(Origin=c_script.A, XAxis=md_slider, YAxis=Vector(0, 1, 0))
polygon = Polygon(Plane=pl, Radius=crash_radius, Segments="3", FilletRadius=0)  # -> Polygon, Length
cir = Circle(Plane=c_script.A, Radius=crash_radius)
scale_nu = ScaleNU(Geometry=polygon.Polygon, Plane=pl, ScaleX="2", ScaleY=1, ScaleZ=1)  # -> Geometry, Transform
previewlw_2 = CustomPreviewLineweights(Geometry=cir, Shader=ColourSwatch(SwatchColor=RGB(255, 255, 255)), Absolute=False)
previewlw_3 = CustomPreviewLineweights(Geometry=scale_nu.Geometry, Shader=ColourSwatch(SwatchColor=RGB(255, 0, 0)), Thickness="3", Absolute=False)
