# Grasshopper definition day02_01_AgentSystem.gh (Grasshopper 1.0.7)
# Copyright: Co-de-iT
# plug-ins: ScriptParasite, froGH, Human

number_slider = Slider(100, range=50..500)
rectangle = Rectangle(Plane=PlaneXY(0, 0, 0), XSize="30", YSize="30", Radius=0)  # -> Rectangle, Length
rectangle_2 = Rectangle(Plane=PlaneXY(0, 0, 0), XSize="-1 to 1", YSize="-1 to 1", Radius=0)  # -> Rectangle, Length
pop2d = Populate2D(Region=rectangle_2.Rectangle, Count=number_slider, Seed="2")
pop2d_2 = Populate2D(Region=rectangle.Rectangle, Count=number_slider, Seed=1)
previewlw = CustomPreviewLineweights(Geometry=rectangle.Rectangle, Shader=ColourSwatch(SwatchColor=RGB(196, 196, 196)), Absolute=False)
unit = UnitVector(Vector=pop2d)
vdisex = VectorDisplayEx(Point=pop2d_2, Vector=unit, Colour=RGB(0, 0, 0), Width=2)
number_slider_2 = Slider(3.5, range=0..10)
reset = Button()
go = BooleanToggle(False)
f_ghfilepath = GHFilePathInfo()  # -> FileName, FilePath
concat = Concatenate(FragmentA=f_ghfilepath.FilePath, FragmentB="scripts")
multiplication = Multiplication(A=number_slider_2, B=Slider(0.3, range=0..1))

agentsystem = CSharpScript(
    reset=reset,
    go=go,
    P=pop2d_2,
    V=unit,
    nR=number_slider_2,
    coS=Slider(0.164, range=0..10),
    alS=Slider(9, range=0..10),
    seS=Slider(2.5, range=0..10),
    seR=multiplication)  # -> out, oP, oV; inputs reset: Boolean, go: Boolean, P: list of Point3d, V: list of Vector3d, nR: Double, coS: Double, alS: Double, seS: Double, seR: Double
# ---------- agentsystem: C# ----------
    // initialize
    if (agSys == null || reset)
      agSys = new AgentSystem(P, V);

    // update
    if (go)
    {
      // update live variables
      agSys.NeighborhoodRadius = nR;
      agSys.CohesionStrength = coS;
      agSys.AlignmentStrength = alS;
      agSys.SeparationStrength = seS;
      agSys.SeparationRadius = seR;

      // simulaiton update
      agSys.Update();
      Component.ExpireSolution(true);
    }
    // output
    outPos = new List<Point3d>();
    outVel = new List<Vector3d>();

    foreach (Agent agent in agSys.agents)
    {
      outPos.Add(agent.position);
      outVel.Add(agent.velocity);
    }

    oP = outPos;
    oV = outVel;
# ---------- agentsystem: C# additional code ----------
  // global variables
  public AgentSystem agSys;
  public List<Point3d> outPos;
  public List<Vector3d> outVel;

  // custom classes
  public class AgentSystem
  {
    // fields
    public List<Agent> agents;
    public double NeighborhoodRadius;
    public double CohesionStrength;
    public double AlignmentStrength;
    public double SeparationStrength;
    public double SeparationRadius;
    public double BoundingBoxSize;
    public double ContainmentStrength;
    public double MaxSpeed;

    // constructor(s)
    public AgentSystem(List<Point3d> points, List<Vector3d> vectors)
    {
      agents = new List<Agent>();

      for (int i = 0; i < points.Count; i++)
      {
        Agent ag = new Agent(points[i], vectors[i]);
        ag.agentSystem = this;
        agents.Add(ag);
      }

      BoundingBoxSize = 30.0;
      ContainmentStrength = 1.0;
      MaxSpeed = 0.3;
    }

    // methods
    public void Update()
    {
      // compute
      foreach (Agent agent in agents)
      {
        //List<Agent> neighbours = FindNeighbours(agent);
        //agent.Compute(neighbours);
        agent.Compute(FindNeighbours(agent));
      }

      // update velocity & position
      foreach (Agent agent in agents)
        agent.UpdateVelocityAndPosition();
    }

    public List<Agent> FindNeighbours(Agent ag)
    {
      List<Agent> neighbours = new List<Agent>();
      foreach (Agent neighbour in agents)
      {
        if (neighbour != ag && ag.position.DistanceTo(neighbour.position) < NeighborhoodRadius)
        {
          neighbours.Add(neighbour);
        }
      }

      return neighbours;
    }

  }

  public class Agent
  {
    // fields
    public Point3d position;
    public Vector3d velocity;
    public Vector3d desired;
    public AgentSystem agentSystem;

    // constructor(s)
    public Agent(Point3d position, Vector3d velocity)
    {
      this.position = position;
      this.velocity = velocity;
    }

    // methods

    public void Compute(List<Agent> neighbours)
    {
      ResetDesired();
      Containment();
      Flocking(neighbours);
    }

    public void Flocking(List<Agent> neighbours)
    {
      if (neighbours.Count == 0) return;

      // . . . . . cohesion

      // find neighbours average
      Point3d average = new Point3d();

      foreach (Agent neighbour in neighbours)
        average += neighbour.position;

      average /= neighbours.Count;

      // go there
      Vector3d cohesion = average - position;

      // update desired
      desired += cohesion * agentSystem.CohesionStrength;

      // . . . . . alignment

      // . . . . . separation

    }

    public void ResetDesired()
    {
      desired = velocity;
    }

    public void Containment()
    {
      if (position.X < 0.0)
        desired += new Vector3d(-position.X, 0, 0);
      else if (position.X > agentSystem.BoundingBoxSize)
        desired += new Vector3d(agentSystem.BoundingBoxSize - position.X, 0, 0);

      if (position.Y < 0.0)
        desired += new Vector3d(0, -position.Y, 0);
      else if (position.Y > agentSystem.BoundingBoxSize)
        desired += new Vector3d(0, agentSystem.BoundingBoxSize - position.Y, 0);

      if (position.Z < 0.0)
        desired += new Vector3d(0, 0, -position.Z);
      else if (position.Z > agentSystem.BoundingBoxSize)
        desired += new Vector3d(0, 0, agentSystem.BoundingBoxSize - position.Z);
    }
    public void UpdateVelocityAndPosition()
    {
      // steering
      velocity = 0.97 * velocity + 0.03 * desired;

      if (velocity.Length > agentSystem.MaxSpeed)
      {
        velocity.Unitize();
        velocity *= agentSystem.MaxSpeed;
      }

      // update position
      position += velocity;
    }
  }
# ---------- end agentsystem ----------
scriptpar = ScriptParasite(Enable=Toggle(False), Folder=concat)

vlen = VectorLength(Vector=agentsystem.oV)
gradient = Gradient(LowerLimit=0, UpperLimit="0.3", Parameter=vlen, stops=[0: RGB(0, 128, 0), 0.5: RGB(255, 255, 0), 1: RGB(255, 0, 0)])
vdisex_2 = VectorDisplayEx(Point=agentsystem.oP, Vector=agentsystem.oV, Colour=gradient, Width=2)
