# Grasshopper definition 00_first components.gh (Grasshopper 1.0.7)
# Copyright: Co-de-iT

c_script = CSharpScript(x=Slider(0.273, range=0..1), y=Slider(0.817, range=0..1))  # -> out, sum, diff; inputs x: Double, y: Double
# ---------- c_script: C# ----------
    // single line comment
    /*
    Multi line
    comment
    */
    // sum = x + y;
    sum = SumOfTwoNumbers(x, y);
    double s = SumOfTwoNumbers(11, 3.14);
    diff = x - y;
# ---------- c_script: C# additional code ----------
  
  //double a;

  double SumOfTwoNumbers(double a, double b)
  {
    double c = a + b;
    return c;
  }

  double DiffOfTwoNumbers(double a, double b)
  {
    return a - b;
  }

  bool IsNumberEven(int num)
  {
    // Comparison operators
    // == equal to
    // != not equal to
    // > larger than, < smaller than
    //    if(num % 2 == 0)
    //      return true;
    //    else
    //      return false;
    return num % 2 == 0;
  }
# ---------- end c_script ----------
c_script_2 = CSharpScript(x=Slider(6, range=0..10), y=Slider(3, range=0..10), z=Slider(0, range=0..10))  # -> out, Pt; inputs x: Double, y: Double, z: Double
# ---------- c_script_2: C# ----------
    Pt = new Point3d(x, y, z);
# ---------- end c_script_2 ----------
# First Components
# 
# <description>
# 
# code by Alessio Erioli
# 
# v 0.1
# © a3 2023 / Creative Commons Attribution-Non Commercial-ShareAlike 4.0 International License
panel = Panel(c_script.sum)
panel_2 = Panel(c_script.diff)
