# Grasshopper definition 02_circuit game.gh (Grasshopper 1.0.7)
# Copyright: Co-de-iT
# plug-ins: Human

# Circuit Game
# 
# Continuous movement and collision detection
# 
# code by Alessio Erioli
# 
# v 0.1
# © a3 2023 / Creative Commons Attribution-Non Commercial-ShareAlike 4.0 International License
md_slider = MDSlider(
    SliderMode=0,
    slider_value=Point(0.1988562852, 0.8524635129, 0.5),
    x_domain=Domain(-1, 1),
    y_domain=Domain(-1, 1),
    z_domain=Domain(0, 1))
number_slider = Slider(10, range=0..10)
crv = Curve(reparameterize(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))
neg = Negative(Value=number_slider)
area = Area(Geometry=crv)  # -> Area, Centroid
merge = Merge(Data1=number_slider, Data2=neg)
speed_limit = Slider(1, range=0..1)
crash_radius = Slider(2.5, range=0..10)
offset = OffsetCurve(Curve=crv, Distance=merge, Corners=1)  # -> flatten(Curve)
eval = EvaluateCurve(Curve=crv, Parameter="0")  # -> Point, Tangent, Angle
go = BooleanToggle(False)
multiplication = Multiplication(A=md_slider, B=speed_limit)
previewlw = CustomPreviewLineweights(Geometry=offset, Shader=ColourSwatch(SwatchColor=RGB(0, 0, 0)), Thickness="5", Absolute=False)
c_script = CSharpScript(reset=Button(), go=go, P=eval.Point, V=multiplication, R=crash_radius, C=offset)  # -> out, Cr, A; inputs reset: Boolean, go: Boolean, P: Point3d, V: Vector3d, R: Double, C: list of Curve
# ---------- c_script: C# usings ----------
using System.Threading;
# ---------- c_script: C# ----------
    // initialization
    if (reset || pointVehicle == null) // || OR,  && AND,  ! NOT
    {
      pointVehicle = new Vehicle(P, V, R);
      crashed = false;
    }

    // Update
    if (go)
    {
      if (crashed)
      {
        Thread.Sleep(1000);
        pointVehicle.position = P;
        crashed = false;
      }
      if (pointVehicle.Crash(C))
      {
        // Print("CRASH!!!!");
        Cr = "CRASH!!!";
        // System.Media.SystemSounds.Beep.Play();
        crashed = true;
      }

      pointVehicle.velocity = V;
      pointVehicle.Move();
      Component.ExpireSolution(true);
    }

    //Print(Iteration.ToString());

    // Output

    A = pointVehicle.position;
# ---------- c_script: C# additional code ----------
  Vehicle pointVehicle;
  bool crashed;

  class Vehicle
  {
    // fields
    public Point3d position;
    public Vector3d velocity;
    public double cRadius;

    // constructors
    public Vehicle(Point3d P, Vector3d V, double R)
    {
      position = P;
      velocity = V;
      cRadius = R;
    }
    // methods
    public void Move()
    {
      // position = position + velocity;
      position += velocity;  // -=  *=  /=
    }

    public bool Crash(List<Curve> circuit)
    {
      bool crashed = false;

      foreach(Curve c in circuit)
      {
        double t;
        if (c.ClosestPoint(position, out t))
        {
          if (position.DistanceTo(c.PointAt(t)) < cRadius)
          {
            crashed = true;
            break;
          }
        }
      }

      return crashed;
    }
  }
# ---------- end c_script ----------
panel = Panel(c_script.out)
tag = TextTag3D(Location=area.Centroid, Text=c_script.Cr, Size="15", Justification=5)
pl = ConstructPlane(Origin=c_script.A, XAxis=md_slider, YAxis=Vector(0, 1, 0))
polygon = Polygon(Plane=pl, Radius=crash_radius, Segments="3", FilletRadius=0)  # -> Polygon, Length
scale_nu = ScaleNU(Geometry=polygon.Polygon, Plane=pl, ScaleX="2", ScaleY=1, ScaleZ=1)  # -> Geometry, Transform
cir = Circle(Plane=c_script.A, Radius=crash_radius)
previewlw_2 = CustomPreviewLineweights(Geometry=cir, Shader=ColourSwatch(SwatchColor=RGB(255, 255, 255)), Absolute=False)
previewlw_3 = CustomPreviewLineweights(Geometry=scale_nu.Geometry, Shader=ColourSwatch(SwatchColor=RGB(255, 0, 0)), Thickness="3", Absolute=False)
