# Grasshopper definition day01_03_CirclesRelaxation.gh (Grasshopper 1.0.7)
# Copyright: Co-de-iT
# plug-ins: ScriptParasite, froGH

# ALWAYS remember
# to set Toggles to False
# before saving and
# closing your files!!!
panel = Panel("-5 to 5")
rectangle = Rectangle(Plane=PlaneXY(0, 0, 0), XSize=panel, YSize=panel, Radius=0)  # -> Rectangle, Length
# Circle Relaxation
# 
# Circles relaxing to avoid collision
# 
# code by Long Nguyen for ICD, adapted by Alessio Erioli
# 
# v 0.1
# © a3 2023 / Creative Commons Attribution-Non Commercial-ShareAlike 4.0 International License
toggle = BooleanToggle(False)
reset = Button()
go = BooleanToggle(False)
f_ghfilepath = GHFilePathInfo()  # -> FileName, FilePath
pop2d = Populate2D(Region=rectangle.Rectangle, Count="100", Seed=1)
concat = Concatenate(FragmentA=f_ghfilepath.FilePath, FragmentB="scripts")

circlerelaxation = CSharpScript(P=pop2d, reset=reset, go=go)  # -> out, C; inputs P: list of Point3d, reset: Boolean, go: Boolean
# ---------- circlerelaxation: C# ----------
    // initialization
    if (reset || centers == null)
      centers = new List<Point3d>(P);

    List<Vector3d> totalMoves = new List<Vector3d>();
    List<double> collisionCounts = new List<double>();

    for (int i = 0; i < centers.Count; i++)
    {
      totalMoves.Add(new Vector3d(0.0, 0.0, 0.0));
      collisionCounts.Add(0.0);
    }

    double collisionDistance = 2.0;

    // update
    if (go)
    {
      // compute simulation
      for (int i = 0; i < centers.Count; i++)
        for (int j = i + 1; j < centers.Count; j++)
        {
          double d = centers[i].DistanceTo(centers[j]);
          if (d > collisionDistance) continue;
          Vector3d move = centers[i] - centers[j];
          move.Unitize();
          move *= (collisionDistance - d) * 0.5;// * 0.6; < add a factor between 0 and 1 to dampen the relaxation further
          totalMoves[i] += move;
          totalMoves[j] -= move;
          collisionCounts[i] += 1;
          collisionCounts[j] += 1;
        }
      // update particles
      for (int i = 0; i < centers.Count; i++)
        if (collisionCounts[i] != 0.0)
          centers[i] += totalMoves[i] / collisionCounts[i];

      Component.ExpireSolution(true);
    }

    // output
    C = centers;
# ---------- circlerelaxation: C# additional code ----------
  List<Point3d> centers;
# ---------- end circlerelaxation ----------
scriptpar = ScriptParasite(Enable=toggle, Folder=concat)

panel_2 = Panel(concat)
cir = Circle(Plane=circlerelaxation.C, Radius="1")
