# Grasshopper definition 04_CurveGrowth.gh (Grasshopper 1.0.7)
# Copyright: Co-de-iT
# plug-ins: ScriptParasite, froGH, Human

crv = Curve(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)
cir = Circle(Plane=PlaneXY(0, 0, 0), Radius="10")
divide = DivideCurve(Curve=crv, Count="50", Kinks=False)  # -> Points, Tangents, Parameters

# ----
# How insert works
number_slider = Slider(4, range=0..9)
series = Series(Start=0, Step=1, Count=10)
panel = Panel(series)
c_script = CSharpScript(x=series, y=number_slider)  # -> out, A; inputs x: list of Int32, y: Int32
# ---------- c_script: C# ----------
    x.Insert(y, 42);
    A = x;
# ---------- end c_script ----------
panel_2 = Panel(c_script.A)

f_ghfilepath = GHFilePathInfo()  # -> FileName, FilePath
reset = Button()
go = BooleanToggle(False)
# Curve Growth
# 
# Curve Laplacian Growth
# 
# code by Long Nguyen for ICD, adapted by Alessio Erioli
# 
# v 0.1
# © a3 2023 / Creative Commons Attribution-Non Commercial-ShareAlike 4.0 International License
toggle = BooleanToggle(False)
concat = Concatenate(FragmentA=f_ghfilepath.FilePath, FragmentB="scripts")

curvegrowth = CSharpScript(reset=reset, go=go, P=divide.Points, maxCount="1500")  # -> out, Pc; inputs reset: Boolean, go: Boolean, P: list of Point3d, maxCount: Int32
# ---------- curvegrowth: C# ----------
    // initialization
    if (reset || centers == null)
      centers = new List<Point3d>(P);

    List<Vector3d> totalMoves = new List<Vector3d>();
    List<double> collisionCounts = new List<double>();

    for (int i = 0; i < centers.Count; i++)
    {
      totalMoves.Add(new Vector3d(0.0, 0.0, 0.0));
      collisionCounts.Add(0.0);
    }

    // Update
    double collisionDistance = 2.0;
    double growthDistance = 1.99;

    if (go)
    {

      // compute collisions
      for (int i = 0; i < centers.Count; i++)
        for (int j = i + 1; j < centers.Count; j++)
        {
          double d = centers[i].DistanceTo(centers[j]);
          if (d > collisionDistance) continue;
          Vector3d move = centers[i] - centers[j];
          if (move.Length < 0.001) continue;
          move.Unitize();
          move *= 0.5 * (collisionDistance - d);
          totalMoves[i] += move;
          totalMoves[j] -= move;
          collisionCounts[i] += 1.0;
          collisionCounts[j] += 1.0;
        }
      // update positions
      for (int i = 0; i < centers.Count; i++)
        if (collisionCounts[i] != 0.0)
          centers[i] += totalMoves[i] / collisionCounts[i];
      // growth
      if (centers.Count < maxCount)
      {
        for(int i=0; i< centers.Count -1; i++)
          if (centers[i].DistanceTo(centers[i + 1]) > growthDistance)
          {
            Point3d newCenter = (centers[i] + centers[i + 1]) * 0.5;
            centers.Insert(i+1, newCenter);
          }
      }


      // refresh component
      Component.ExpireSolution(true);
    }

    // Output
    Pc = centers;
# ---------- curvegrowth: C# additional code ----------
  List<Point3d> centers;
# ---------- end curvegrowth ----------
scriptpar = ScriptParasite(Enable=toggle, Folder=concat)

cir_2 = Circle(Plane=curvegrowth.Pc, Radius=1)
pline = PolyLine(Vertices=curvegrowth.Pc, Closed=False)
explode = Explode(Curve=pline, Recursive=True)  # -> Segments, Vertices
msphere = MeshSphere(Base=cir_2, Radius="1", UCount="8", VCount="8")  # disabled
previewlw = CustomPreviewLineweights(Geometry=cir_2, Shader=ColourSwatch(SwatchColor=RGB(212, 212, 212)), Absolute=False)
len = Length(Curve=explode.Segments)
gradient = Gradient(LowerLimit="1", UpperLimit="2", Parameter=len, stops=[0: RGB(0, 128, 0), 0.5: RGB(255, 255, 0), 1: RGB(255, 0, 0)])
preview = CustomPreview(
    Geometry=msphere,
    Material={diffuse=RGB(221, 160, 221), emission=RGB(66, 48, 66), shine=0.5, specular=RGB(255, 255, 255), transparency=0})  # disabled
previewlw_2 = CustomPreviewLineweights(Geometry=explode.Segments, Shader=gradient, Thickness="3", Absolute=False)
