# Grasshopper definition CustomGoal_Example2.gh (Grasshopper 1.0.7)
# plug-ins: Kangaroo2 Components, ScriptParasite, froGH

f_ghfilepath = GHFilePathInfo()  # -> FileName, FilePath
# C:\Program Files\Rhino 7\Plug-ins\Grasshopper\Components\KangarooSolver.dll
panel = Panel("scripts")
crv = Curve(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)
# Adding External Libraries (Assemblies): . Add the Library to the C# Component via Manage Assemblies
# 
# . in VIsual Studio, go to the Solution Explorer, under <Your Project name> > Dependencies > Assemblies. Right-click on "Assemblies" > Add Assembly reference
# 
# . use Browse to look for the .dll library (see above for the KangarooSolver.dll path)
# 
# . Double-click on <Your Project name> to view the .csproj file
# 
# . save the .csproj file
panel_2 = Panel("1")
# right-click > Manage Assemblies
concat = Concatenate(FragmentA=f_ghfilepath.FilePath, FragmentB=panel)

constanttension = CSharpScript(L=crv, k=panel_2, Reference="C:\PROGRAM FILES\RHINO 7\PLUG-INS\GRASSHOPPER\COMPONENTS\KangarooSolver.dll")  # -> out, A; inputs L: Line, k: Double
# ---------- constanttension: C# usings ----------
using KPlankton;
using KangarooSolver;
using KangarooSolver.Goals;
# ---------- constanttension: C# ----------
    A = new NewSpring(L.From, L.To, k);
# ---------- constanttension: C# additional code ----------
  public class NewSpring : GoalObject
  {
    public NewSpring(Point3d s, Point3d e, double k)
    {
      PPos = new Point3d[2] { s, e }; //initial positions
      Move = new Vector3d[2];
      Weighting = new double[2]{k,k};
    }

    public override void Calculate(List<KangarooSolver.Particle> p)
    {
      var Positions = this.GetCurrentPositions(p);
      var StartPt = Positions[0];
      var EndPt = Positions[1];

      Vector3d CurrentVector = EndPt - StartPt;

      double CurrentLength = CurrentVector.Length;

      double RestLength = 3.0;

      double Stretch = CurrentLength - RestLength;

      CurrentVector.Unitize();

      Move[0] = 0.5 * CurrentVector * Stretch;
      Move[1] = -Move[0];
    }

    public override object Output(List<KangarooSolver.Particle> p)
    {
      return new Line(p[PIndex[0]].Position, p[PIndex[1]].Position);
    }
  }
# ---------- end constanttension ----------
# Kangaroo - Custom Goal
# 
# <description>
# 
# code by Daniel Piker
# 
# v 0.1
# © a3 2023 / Creative Commons Attribution-Non Commercial-ShareAlike 4.0 International License
scriptpar = ScriptParasite(Enable=Toggle(False), Folder=concat)

grab = Grab(On=True, Strength=1, Range=3)  # -> Grab, Anchors
solver = Solver(GoalObjects=[constanttension.A, grab.Grab], Reset=Button(), Threshold=1e-15, Tolerance=0.01, On=True)  # -> I, V, O
