# Grasshopper definition GoalDebugger.gh (Grasshopper 1.0.7)
# plug-ins: Kangaroo2 Components, ScriptParasite, froGH

crv = Curve(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)
explode = Explode(Curve=crv, Recursive=True)  # -> Segments, Vertices
pt = Point(Point(28.57683276, 8.147694793, 0))
length_line = LengthLine(Line=explode.Segments, Length=5, Strength=1)
anchor = Anchor(Point=Point(5.80202585, 7.003942027, 0), Strength=1000)
load = Load(Point=pt, ForceVector=Vector(0, -4, 0))
# © a3 2023 / Creative Commons Attribution-Non Commercial-ShareAlike 4.0 International License
f_ghfilepath = GHFilePathInfo()  # -> FileName, FilePath
reset = Button(ExpressionPressed="true")
step = Button(ExpressionPressed="true")
# Kangaroo - Goal Debugger
# 
# <description>
# 
# code by Daniel Piker
# 
# v 0.1
toggle = BooleanToggle(False)
concat = Concatenate(FragmentA=f_ghfilepath.FilePath, FragmentB="scripts")

goaldebugger = CSharpScript(
    Goals=flatten([length_line, load, anchor]),
    Reset=reset,
    Step=step,
    Reference="C:\PROGRAM FILES\RHINO 7\PLUG-INS\GRASSHOPPER\COMPONENTS\KangarooSolver.dll")  # -> out, A, B, C, D, E, F; inputs Goals: list, Reset: Boolean, Step: Boolean
# ---------- goaldebugger: C# usings ----------
using System.Linq;
using KPlankton;
using KangarooSolver;
using KangarooSolver.Goals;
# ---------- goaldebugger: C# ----------
    if(Reset)
    {
      PS = new KangarooSolver.PhysicalSystem();
      counter = 0;
      GoalList.Clear();
      foreach(IGoal G in Goals) //Assign indexes to the particles in each Goal:
      {
        PS.AssignPIndex(G, 0.0001); // the second argument is the tolerance distance below which points combine into a single particle
        GoalList.Add(G);
      }
    }
    if(Step)
    {
      PS.SimpleStep(GoalList);
      counter++;
    }


    A = PS.GetOutput(GoalList);
    B = counter;
    C = PS.GetAllMoves(GoalList);
    D = PS.GetAllWeightings(GoalList);
    E = PS.GetPositionArray();

    var Names = new List<String>[PS.ParticleCount()];

    for(int i = 0; i < PS.ParticleCount();i++)
    {
      Names[i] = new List<String>();
    }

    for(int i = 0;i < GoalList.Count;i++)
    {
      var FullName = GoalList[i].ToString();
      Char splitter = '.';
      var Name = FullName.Split(splitter);
      var G = GoalList[i] as IGoal;

      for(int j = 0; j < G.PIndex.Count();j++)
      {
        Names[G.PIndex[j]].Add(Name[2]);
      }
    }


    F = Names;
# ---------- goaldebugger: C# additional code ----------
  KangarooSolver.PhysicalSystem PS = new KangarooSolver.PhysicalSystem();
  List<IGoal> GoalList = new List<IGoal>();
  int counter = 0;
# ---------- end goaldebugger ----------
scriptpar = ScriptParasite(Enable=toggle, Folder=concat)

c_script = CSharpScript(x=goaldebugger.F)  # -> A
# ---------- c_script: C# ----------
    A = x as List<string>;
# ---------- end c_script ----------
panel = Panel(goaldebugger.B)
c_script_2 = CSharpScript(x=goaldebugger.D)  # -> A
# ---------- c_script_2: C# ----------
    A = x as List<double>;
# ---------- end c_script_2 ----------
c_script_3 = CSharpScript(x=goaldebugger.C)  # -> A
# ---------- c_script_3: C# ----------
    A = x as List<Vector3d>;
# ---------- end c_script_3 ----------
concat_2 = Concatenate(FragmentA=c_script, FragmentC="  ", FragmentB=c_script_2)
addition = Addition(A=graft(goaldebugger.E), B=c_script_3)
vdis = VectorDisplay(Anchor=graft(goaldebugger.E), Vector=c_script_3)
tag = TextTag(Location=addition, Text=concat_2, Colour=ColourSwatch(SwatchColor=RGB(0, 0, 0)))
