# Grasshopper definition StepByStep.gh (Grasshopper 1.0.7)
# plug-ins: Kangaroo2 Components, ScriptParasite, froGH

mesh = Mesh(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)
# Another simple scripting example,
# showing how the simulation can
# be advanced one iteration at a time
nv = NakedVertices(Mesh=mesh)  # -> ClothedIndex, NakedIndex, ClothedPts, NakedPts
medges = MeshEdges(Mesh=mesh)  # -> NakedEdges, InteriorEdges, NonManifoldEdges
reset = Button(ExpressionPressed="true")
step = Button(ExpressionPressed="true")
f_ghfilepath = GHFilePathInfo()  # -> FileName, FilePath
length_line = LengthLine(Line=[medges.InteriorEdges, medges.NakedEdges], Length="0", Strength=10)
anchor = Anchor(Point=nv.NakedPts, Strength=1000)
# Kangaroo - Step by Step
# 
# <description>
# 
# code by Daniel Piker
# 
# v 0.1
# © a3 2023 / Creative Commons Attribution-Non Commercial-ShareAlike 4.0 International License
toggle = BooleanToggle(False)
concat = Concatenate(FragmentA=f_ghfilepath.FilePath, FragmentB="scripts")

# ----
# You will need to set the assembly
# reference location to your copy of
# KangarooSolver.dll
# Do this by right-clicking and then
# Manage Assemblies
stepbystep = CSharpScript(
    Goals=[anchor, length_line],
    Reset=reset,
    Step=step,
    Reference="C:\PROGRAM FILES\RHINO 7\PLUG-INS\GRASSHOPPER\COMPONENTS\KangarooSolver.dll")  # -> out, A, B; inputs Goals: list, Reset: Boolean, Step: Boolean
# ---------- stepbystep: C# usings ----------
using KPlankton;
using KangarooSolver;
using KangarooSolver.Goals;
# ---------- stepbystep: C# ----------
    if(Reset)
    {
      PS = new KangarooSolver.PhysicalSystem();
      counter = 0;
      GoalList.Clear();
      foreach(IGoal G in Goals) //Assign indexes to the particles in each Goal:
      {
        PS.AssignPIndex(G, 0.0001); // the second argument is the tolerance distance below which points combine into a single particle
        GoalList.Add(G);
      }
    }
    if(Step)
    {
      PS.Step(GoalList, true, 1);
      counter++;
    }

    A = PS.GetOutput(GoalList);
    B = counter;
# ---------- stepbystep: C# additional code ----------
  KangarooSolver.PhysicalSystem PS = new KangarooSolver.PhysicalSystem();
  List<IGoal> GoalList = new List<IGoal>();
  int counter = 0;
# ---------- end stepbystep ----------
scriptpar = ScriptParasite(Enable=toggle, Folder=concat)

panel = Panel(stepbystep.B)
