# Grasshopper definition pointcreation.gh (Grasshopper 1.0.7)
# plug-ins: ScriptParasite, froGH

f_ghfilepath = GHFilePathInfo()  # -> FileName, FilePath
brep = Brep(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)
pt = Point([Point(17, 17, 0), Point(21, 4, 0), Point(31, 16, 0)])
timer = Timer(Interval=1, TimerInterval=5, Target=pointcreation)  # disabled
concat = Concatenate(FragmentA=f_ghfilepath.FilePath, FragmentB="scripts")

pointcreation = CSharpScript(
    StartPoints=pt,
    TargetMesh=brep,
    Reset=Button(),
    Reference="C:\PROGRAM FILES\RHINO 7\PLUG-INS\GRASSHOPPER\COMPONENTS\KangarooSolver.dll")  # -> out, A, B; inputs StartPoints: list of Point3d, TargetMesh: Mesh, Reset: Boolean
# ---------- pointcreation: C# usings ----------
using System.Linq;

using KPlankton;
using KangarooSolver;
using KangarooSolver.Goals;
# ---------- pointcreation: C# ----------
    if(Reset || Points == null)
    {
      Points = StartPoints;
    }

    else
    {
      var AveragePoint = new Point3d();
      foreach (Point3d P in Points)
      {
        AveragePoint = AveragePoint + P;
      }
      AveragePoint *= 1.0 / Points.Count;
      Points.Add(AveragePoint);

      var PS = new KangarooSolver.PhysicalSystem();

      List<IGoal> MyGoals = new List<IGoal>();

      var CollideGoal = new KangarooSolver.Goals.SphereCollide(Points, 1, 1);
      MyGoals.Add(CollideGoal);
      var OnMeshGoal = new KangarooSolver.Goals.OnMesh(Points, TargetMesh, 1);
      MyGoals.Add(OnMeshGoal);

      foreach(IGoal G in MyGoals)
      {
        PS.AssignPIndex(G, 0.01);
      }

      PS.Step(MyGoals, true, 0.00001);
      Points = PS.GetPositions().ToList();
    }

    A = Points;
# ---------- pointcreation: C# additional code ----------
  List<Point3d> Points;
# ---------- end pointcreation ----------
# Kangaroo - Point Creation
# 
# <description>
# 
# code by Daniel Piker
# 
# v 0.1
# © a3 2023 / Creative Commons Attribution-Non Commercial-ShareAlike 4.0 International License
scriptpar = ScriptParasite(Enable=Toggle(False), Folder=concat)

panel = Panel(pointcreation.out)
