# Grasshopper definition Evolving Jitterbugs.gh (Grasshopper 1.0.7)
# Copyright: Co-de-iT
# plug-ins: froGH, ScriptParasite, Human

# https://natureofcode.com/book/chapter-9-the-evolution-of-code/
# SETUP:
# 
# Step 1: Initialize. Create a population of N elements, each with randomly generated DNA.
# 
# LOOP:
# 
# Step 2: Selection. Evaluate the fitness of each element of the population and build a mating pool.
# 
# Step 3: Reproduction. Repeat N times:
# 
#            a) Pick two parents with probability according to relative fitness.
#            b) Crossover—create a “child” by combining the DNA of these two parents.
#            c) Mutation—mutate the child’s DNA based on a given probability.
#            d) Add the new child to a new population.
# 
# Step 4. Replace the old population with the new population and return to Step 2.
# Possible addition:
# 
# . to keep the "all time best" record previous episode's best fitness value and compare it with the new one
# 
# . or store fitness with brain (so one can pick the fittest brain)
number_slider = Slider(30.733, range=1..50)
f_cdom = CenteredDomain(DomainLength=number_slider)
f_cdom_2 = CenteredDomain(DomainLength=Slider(1.688, range=1..50))
f_cdom_3 = CenteredDomain(DomainLength=Slider(30.733, range=1..50))
f_cdom_4 = CenteredDomain(DomainLength=Slider(30.733, range=1..50))
f_cdom_5 = CenteredDomain(DomainLength=Slider(1.688, range=1..50))
f_cdom_6 = CenteredDomain(DomainLength=Slider(1.688, range=1..50))
pt = Point(Point(0, 11.71826307, 0))
pt_2 = Point(Point(-10.1156101, 19.70241685, 0))
pt_3 = Point(Point(14.82446685, 7.36483705, 0))
rectangle = Rectangle(Plane=pt, XSize=f_cdom, YSize=f_cdom_2, Radius=0)  # -> Rectangle, Length
rectangle_2 = Rectangle(Plane=pt_3, XSize=f_cdom_3, YSize=f_cdom_5, Radius=0)  # -> Rectangle, Length
rectangle_3 = Rectangle(Plane=pt_2, XSize=f_cdom_4, YSize=f_cdom_6, Radius=0)  # -> Rectangle, Length

# ----
# obstacles
crv = Curve([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])
swatch = ColourSwatch(SwatchColor=RGB(0, 0, 0))
merge = Merge(Data1=crv, Data2=rectangle_3.Rectangle, Data3=rectangle_2.Rectangle)
smesh = SimpleMesh(Brep=merge)
preview = CustomPreview(Geometry=smesh, Material=swatch)
previewlw = CustomPreviewLineweights(Geometry=merge, Shader=swatch, Thickness="3", Absolute=False)

pt_4 = Point(Point(0, -1, 0))
pt_5 = Point(Point(0, 27.86123576, 0))
iterations = Slider(100, range=10..200)
episodes = Slider(20, range=1..100)
mutation_rate = Slider(0.02, range=0..1)
max_angle = Slider(40, range=0..360)
n_bugs = Slider(1000, range=10..1000)
# Evolving JitterBugs
# 
# JitterBugs following Darwinian selection
# 
# code by Alessio Erioli
# 
# v 0.1
# © a3 2023 / Creative Commons Attribution-Non Commercial-ShareAlike 4.0 International License
f_ghfilepath = GHFilePathInfo()  # -> FileName, FilePath
concat = Concatenate(FragmentA=f_ghfilepath.FilePath, FragmentB="records\")

# ----
# target
swatch_2 = ColourSwatch(SwatchColor=RGB(0, 195, 255))
dots = DotDisplay(Point=pt_5, Colour=swatch_2, Size="0.35")

sync_code = BooleanToggle(False)
rad = Radians(Degrees=max_angle)
reset = Button()
go = BooleanToggle(False)
concat_2 = Concatenate(FragmentA=f_ghfilepath.FilePath, FragmentB="scripts")

jitterbugs = CSharpScript(
    go=go,
    reset=reset,
    path=concat,
    iter=iterations,
    episodes=episodes,
    mR=mutation_rate,
    mA=rad,
    nB=n_bugs,
    P=pt_4,
    T=pt_5,
    O=merge)  # -> out, o_P, o_V, bFitness, gen, iters; inputs go: Boolean, reset: Boolean, path: String, iter: Int32, episodes: Int32, mR: Double, mA: Double, nB: Int32, P: Point3d, T: Point3d, O: list of Polyline
# ---------- jitterbugs: C# usings ----------
using System.IO;
# ---------- jitterbugs: C# ----------
    // reset & initialize conditions
    if (reset || bugSimulation == null)
    {
      // initialize simulation
      bugSimulation = new BugSystem(nB, P, mA, mR, iter, episodes, path)
      {
        target = T,
        obstacles = O
      };
      return;
    }

    // update variables
    // episodes can be increased if the fitness is not satisfactory
    if (!go)
    {
      bugSimulation.maxEpisodes = episodes;
    }

    // simulate current iteration
    if (go && !bugSimulation.EndEpisode())
    {
      bugSimulation.Update();
      Component.ExpireSolution(true);
    }

    // check if episode is finished
    if (bugSimulation.EndEpisode())
    {
      // compute fitness and find best bug
      bugSimulation.ComputeFitnesses();
      bugSimulation.FindBestBug();

      // record episode
      bugSimulation.RecordEpisode();

      // if simulation is not ended prepare next episode
      if (!bugSimulation.EndSimulation()) bugSimulation.PrepareNextEpisode();
    }

    // output
    // output variables
    List<GH_Point> positions = new List<GH_Point>();
    List<GH_Vector> velocities = new List<GH_Vector>();

    foreach (JitterBug bug in bugSimulation.bugs)
    {
      positions.Add(new GH_Point(bug.position));
      velocities.Add(new GH_Vector(bug.velocity));
    }

    o_P = positions;
    o_V = velocities;
    bFitness = bugSimulation.fitnesses;
    gen = bugSimulation.currEpisode;
    iters = bugSimulation.currIteration;
# ---------- jitterbugs: C# additional code ----------
  BugSystem bugSimulation;

  public class BugSystem
  {
    public JitterBug[] bugs;
    public List<Polyline> obstacles;
    public List<GH_Number> fitnesses;
    public JitterBug bestBug;
    public Point3d target;
    public int maxIterations;
    public int currIteration;
    public int maxEpisodes;
    public int currEpisode;
    public double threshold;
    public double totalFitness;
    public Random rnd;
    public int seed;
    public string bugExport;
    public string brainExport;
    public string path;

    public BugSystem(int nBugs, Point3d basePoint, double maxAngle, double mutationRate, int maxIterations, int maxEpisodes, string path)
    {
      bugs = new JitterBug[nBugs];
      this.maxIterations = maxIterations;
      this.maxEpisodes = maxEpisodes;
      currEpisode = 0;
      currIteration = 0;
      threshold = 1.0;
      seed = DateTime.Now.Hour + DateTime.Now.Minute + DateTime.Now.Second;
      rnd = new Random(seed);

      for (int i = 0; i < nBugs; i++)
        bugs[i] = new JitterBug(this, basePoint, mutationRate);

      fitnesses = new List<GH_Number>();
      for (int i = 0; i < nBugs; i++) fitnesses.Add(new GH_Number(0));

      this.path = path;

      InitDirectory();
    }

    public void Update()
    {
      foreach (JitterBug bug in bugs) bug.Update();
      currIteration++;
    }
    public bool Genocide()
    {
      bool genocide = true;
      foreach (JitterBug bug in bugs)
        if (!bug.dead)
        {
          genocide = false;
          break;
        }

      return genocide;
    }

    public bool EndEpisode()
    {
      return (currIteration >= maxIterations-1) || Genocide();
    }

    public bool EndSimulation()
    {
      return currEpisode >= maxEpisodes - 1;
    }

    public void InitDirectory()
    {
      string subPath = DateTime.Now.Year.ToString() + DateTime.Now.Month.ToString("00") + DateTime.Now.Day.ToString("00") + "_" +
        DateTime.Now.Hour.ToString("00") + DateTime.Now.Minute.ToString("00") + "\\";
      path += subPath;

      if (!Directory.Exists(path)) Directory.CreateDirectory(path);
      return;
    }

    public void RecordEpisode()
    {
      ConvertToString();
      WriteToFile(path);
    }

    public void ConvertToString()
    {
      bugExport = "";
      for (int i = 0; i < bugs.Length; i++)
      {
        JitterBug bug = bugs[i];
        bugExport += string.Format("{0},{1},{2},{3}", bug.position.X, bug.position.Y, bug.nMoves + 1, bug.fitness);
        if (i < bugs.Length - 1) bugExport += "\n";
      }

      brainExport = bestBug.nMoves.ToString() + "\n";
      for (int i = 0; i < bestBug.brain.actions.Length; i++)
      {
        brainExport += bestBug.brain.actions[i].ToString();
        if (i < bestBug.brain.actions.Length - 1) brainExport += "\n";
      }
    }

    public void WriteToFile(string path)
    {
      string epPath = path + "episode_" + currEpisode.ToString() + ".txt";
      string brainPath = path + "brain_" + currEpisode.ToString() + ".txt";
      File.WriteAllText(epPath, bugExport);
      File.WriteAllText(brainPath, brainExport);
    }

    public void ResetEpisode()
    {
      currIteration = 0;
      currEpisode++;
      foreach (JitterBug bug in bugs) bug.Reset();
    }

    public void PrepareNextEpisode()
    {
      // select parents and make offspring
      NaturalSelection();

      // mutate children bugs
      MutateBugs();

      // reset episode variables
      ResetEpisode();
    }

    public void ComputeFitnesses()
    {
      fitnesses.Clear();
      foreach (JitterBug b in bugs)
      {
        b.ComputeFitness();
        fitnesses.Add(new GH_Number(b.fitness));
      }
    }

    public void ComputeTotalFitness()
    {
      totalFitness = 0;
      foreach (JitterBug b in bugs) totalFitness += b.fitness;
    }

    public void FindBestBug()
    {
      int best = 0;
      double maxScore = bugs[0].fitness;

      for (int i = 1; i < bugs.Length; i++)
      {
        if (bugs[i].fitness > maxScore)
        {
          maxScore = bugs[i].fitness;
          best = i;
        }
      }

      bestBug = bugs[best].Clone();
      bestBug.nMoves = bugs[best].nMoves;
    }

    public JitterBug GetParent()
    {
      double scoreThres = rnd.NextDouble() * totalFitness;

      double runningSum = 0;

      for (int i = 0; i < bugs.Length; i++)
      {
        runningSum += bugs[i].fitness;
        if (runningSum > scoreThres)
        {
          return bugs[i];
        }
      }

      // this should never happen
      return null;
    }

    public void NaturalSelection()
    {
      JitterBug[] newBugs = new JitterBug[bugs.Length];

      // compute total fitness
      ComputeTotalFitness();

      // reset bestBug nMoves
      bestBug.nMoves = -1;

      // insert best bug at index 0
      newBugs[0] = bestBug;

      for (int i = 1; i < newBugs.Length; i++)
      {
        // select parent based on fitness
        JitterBug parent = GetParent();

        // new bug is the parent's clone
        newBugs[i] = parent.Clone();
      }

      bugs = (JitterBug[])newBugs.Clone();
    }

    public void MutateBugs()
    {
      for (int i = 0; i < bugs.Length; i++)
        bugs[i].brain.Mutate();
    }
  }

  /// <summary>
  /// JitterBug class
  /// </summary>
  public class JitterBug
  {
    public BugSystem bugsim;
    public Point3d position;
    public Point3d initPos;
    public Vector3d velocity;
    public Vector3d acceleration;
    public bool arrived;
    public bool dead;
    public double fitness;
    public double maxSpeed;
    static int id;
    public int seed;
    public int nMoves;
    public Brain brain;

    public JitterBug(BugSystem bugsim, Point3d position, double mutationRate)
    {
      this.bugsim = bugsim;
      this.position = position;
      initPos = position;
      velocity = Vector3d.Zero;
      arrived = false;
      dead = false;
      fitness = 0.0;
      maxSpeed = 1.0;
      nMoves = -1;
      seed = id;
      brain = new Brain(seed, bugsim.maxIterations, mutationRate);
      id++;
    }

    public JitterBug Clone()
    {
      JitterBug clone = new JitterBug(bugsim, initPos, brain.mutationRate);
      clone.brain = brain.Clone(clone.seed);
      return clone;
    }

    public JitterBug CloneWithActions(Vector3d[] actions)
    {
      JitterBug clone = new JitterBug(bugsim, initPos, brain.mutationRate);
      // clone actions only to preserve new seed for random
      clone.brain.actions = (Vector3d[])actions.Clone();
      return clone;
    }

    public void Reset()
    {
      position = initPos;
      dead = false;
      arrived = false;
      nMoves = -1;
    }

    public void Update()
    {
      if (dead || arrived) return;
      nMoves++;
      acceleration = brain.actions[nMoves];
      Move();
      CheckBoundaries();
      Arrived();
    }

    private void CheckBoundaries()
    {
      foreach (Polyline obstacle in bugsim.obstacles)
      {
        if (obstacle.ClosestPoint(position).DistanceToSquared(position) < 0.5)
        {
          dead = true;
          break;
        }
      }
    }

    public void Move()
    {
      velocity += acceleration;
      if (velocity.Length > maxSpeed)
      {
        velocity.Unitize();
        velocity *= maxSpeed;
      }
      position += velocity;
    }

    public void Arrived()
    {
      arrived = position.DistanceToSquared(bugsim.target) < bugsim.threshold;
    }

    public void ComputeFitness()
    {
      int penalty = 0;
      if (dead) penalty = 10;
      else if (arrived) penalty = -5;
      fitness = 1 / (position.DistanceToSquared(bugsim.target) + 0.001 + (nMoves + penalty) * 0.1);

      // try this other fitness function and see if it works better or worse

      //double reward = 1;
      //if (dead) reward = 0.1;
      //else if (arrived) reward = 2;
      //fitness = (100000 * reward) / ((position.DistanceToSquared(bugsim.target) + 0.001) * nMoves * nMoves);
    }
  }

  /// <summary>
  /// Brain class
  /// </summary>
  public class Brain
  {
    public Vector3d[] actions;
    public double mutationRate;
    public Random rnd;
    public int seed;
    public int step;

    public Brain(int seed, int nActions, double mutationRate)
    {
      actions = new Vector3d[nActions];
      this.seed = seed;
      this.mutationRate = mutationRate;
      step = 0;
      rnd = new Random(seed);
      Vector3d vel = Vector3d.YAxis;

      RandomizeActions();
    }

    public void RandomizeActions()
    {
      Vector3d vel;

      for (int i = 0; i < actions.Length; i++)
      {
        vel = Vector3d.YAxis;
        vel.Rotate(rnd.NextDouble() * Math.PI * 2, Vector3d.ZAxis);
        actions[i] = vel;
      }
    }

    public Brain Clone(int seed)
    {
      Brain clone = new Brain(seed, actions.Length, mutationRate);

      clone.actions = (Vector3d[])actions.Clone();
      return clone;
    }

    public void Mutate()
    {
      for (int i = 0; i < actions.Length; i++)
      {
        if (rnd.NextDouble() < mutationRate)
        {
          Vector3d newAction = Vector3d.YAxis;
          newAction.Rotate(rnd.NextDouble() * Math.PI * 2, Vector3d.ZAxis);
          actions[i] = newAction;
        }
      }
    }


  }
# ---------- end jitterbugs ----------
scriptpar = ScriptParasite(Enable=sync_code, Folder=concat_2)

# ----
# Read recorded episodes
# activate to read episodes data
f_dirread = DirectoryReader(DirectoryPath=concat)  # -> FileList, SubdirList
panel = Panel(f_dirread.SubdirList)
item = ListItem(List=f_dirread.SubdirList, Index="2", Wrap=True)
vdisex = VectorDisplayEx(Point=jitterbugs.o_P, Vector=expr("x*0.5", jitterbugs.o_V), Colour=RGB(0, 0, 0), Width=2)
concat_3 = Concatenate(FragmentA=concat, FragmentB=item, FragmentC="\")
bar_graph = BarGraph(jitterbugs.bFitness, BarColor=RGB(255, 0, 90))

dots_2 = DotDisplay(Point=jitterbugs.o_P, Colour=ColourSwatch(SwatchColor=RGB(0, 0, 0)), Size=Slider(0.15, range=0..1))

c_script = CSharpScript(cEp=jitterbugs.gen, maxEp=episodes, cIt=jitterbugs.iters, maxIt=iterations)  # -> S; inputs cEp: Int32, maxEp: Int32, cIt: Int32, maxIt: Int32
# ---------- c_script: C# ----------
    S = string.Format("gen. {0} of {1}\niter. {2} of {3}", cEp, maxEp - 1, cIt, maxIt - 1);
# ---------- end c_script ----------
pt_6 = Point(Point(-22.41884806, -19.49422979, 0))
pt_7 = Point(Point(-10.01315714, -19.49422979, 0))
f_slvdisp = SliderValueDisplay(
    OrientationPlane=pt_7,
    SliderLength=Slider(10, range=10..100),
    TextSize=Slider(0.78, range=0..1),
    BaseColor=RGB(169, 169, 169),
    HighlightColor=RGB(0, 0, 0),
    S0=mutation_rate,
    S1=max_angle,
    S2=n_bugs)
tag = TextTag3D(Location=pt_6, Text=c_script, Size=1, Colour=ColourSwatch(SwatchColor=RGB(0, 0, 0)), Justification=7)

index = Slider(1, range=0..1)
subtraction = Subtraction(A=episodes, B="1")
multiplication = Multiplication(A=subtraction, B=index)
f_ifromn = IndexesFromNumber(Amount=episodes)
int = Integer(multiplication)
item_2 = ListItem(List=f_ifromn, Index=int, Wrap=True)
episode = Panel(int)

# ----
# record frames
# attach to C input
# to record frames
panel_2 = Panel("10")
mod = Modulus(A=jitterbugs.iters, B=panel_2)
equals = Equality(FirstNumber=mod, SecondNumber="0")  # -> Equality, Inequality
and = GateAnd(A=go, B=equals.Equality)
concat_4 = Concatenate(FragmentA=f_ghfilepath.FilePath, FragmentB="frames\")
f_vc2f = ViewCaptureToFile(
    FilePath=concat_4,
    FileName="screenshot.png",
    ViewportName="Top",
    ImageSize="900x1600",
    Scale=1,
    Grid=False,
    Axes=False,
    Widget=False,
    Capture=False)

panel_3 = Panel(concat_3)

panel_4 = Panel("""episode_
brain_""")
concat_5 = Concatenate(FragmentD=concat_3, FragmentA=panel_4, FragmentB=item_2, FragmentC=".txt")

gate = StreamGate(Stream=concat_5, Gate=go)  # -> Target0, Target1

file = ReadFile(File=gate.Target0, PerLineParse=True)
bang = ExplodeTree(Data=file)  # -> flatten(Branch0), flatten(Branch1)

split = TextSplit(Text=bang.Branch0, Separators=",")
item_3 = ListItem(List=split, Index=0, Wrap=True)  # -> flatten(Item), flatten(Item1), flatten(Item2), flatten(Item3)
pt_8 = ConstructPoint(XCoordinate=item_3.Item, YCoordinate=item_3.Item1, ZCoordinate=0)
sqr = Square(Value=item_3.Item2)
bnd = Bounds(Numbers=item_3.Item3)
dedomain = DeconstructDomain(Domain=bnd)  # -> Start, End
bnd_2 = Bounds(Numbers=sqr)
gradient = Gradient(
    LowerLimit=dedomain.End,
    UpperLimit=dedomain.Start,
    Parameter=item_3.Item3,
    stops=[0: RGB(0, 128, 0), 0.5: RGB(255, 255, 0), 1: RGB(255, 0, 0)])
remap = RemapNumbers(Value=sqr, Source=bnd_2, Target="0.4 to 0.2")  # -> Mapped, Clipped
dots_3 = DotDisplay(Point=pt_8, Colour=gradient, Size=remap.Mapped)

split_2 = SplitList(List=bang.Branch1, Index="1")  # -> ListA, ListB
split_3 = TextSplit(Text=split_2.ListB, Separators=",")
item_4 = ListItem(List=split_3, Index=0, Wrap=True)  # -> flatten(Item), flatten(Item1), flatten(Item2)
vec = VectorXYZ(XComponent=item_4.Item, YComponent=item_4.Item1, ZComponent=item_4.Item2)  # -> Vector, Length

subset = SubList(List=vec.Vector, Domain=split_2.ListA, Wrap=True)  # -> List, Index

c_script_2 = CSharpScript(P=pt_4, A=subset.List)  # -> out, pts; inputs P: Point3d, A: list of Vector3d
# ---------- c_script_2: C# ----------
    Point3d[] points = new Point3d[A.Count + 1];
    points[0] = P;
    Vector3d velocity = Vector3d.Zero;
    Vector3d acceleration;
    double maxSpeed = 1.0;

    for(int i = 0; i < A.Count; i++)
    {
      acceleration = A[i];
      velocity += acceleration;
      if (velocity.Length > maxSpeed)
      {
        velocity.Unitize();
        velocity *= maxSpeed;
      }
      points[i + 1] = points[i] + velocity;
    }

    pts = points;
# ---------- end c_script_2 ----------
pline = PolyLine(Vertices=c_script_2.pts, Closed=False)
previewlw_2 = CustomPreviewLineweights(
    Geometry=pline,
    Shader={diffuse=RGB(255, 105, 180), emission=RGB(76, 32, 54), shine=0.5, specular=RGB(255, 255, 255), transparency=0},
    Thickness="5",
    Absolute=False)
