# Grasshopper definition Perceptron.gh (Grasshopper 1.0.7)
# Copyright: Co-de-iT
# plug-ins: ScriptParasite, froGH, Human

# x
# Wx
# sum
# (i * W)
# activate
# Wy
# P
# y
# Wb
# b
panel = Panel("100")
# 0 / 1
number_slider = Slider(0.01, range=0..0.1)
f_cdom = CenteredDomain(DomainLength=panel)
f_ghfilepath = GHFilePathInfo()  # -> FileName, FilePath
reset = Button()
go = BooleanToggle(False)
rectangle = Rectangle(Plane=PlaneXY(0, 0, 0), XSize=f_cdom, YSize=f_cdom, Radius=0)  # -> Rectangle, Length
concat = Concatenate(FragmentA=f_ghfilepath.FilePath, FragmentB="scripts\")

perceptron = CSharpScript(reset=reset, go=go, nData="2000", LR=number_slider)  # -> out, Points, inf, line, Perceptron_line, Weights, error; inputs reset: Boolean, go: Boolean, nData: Int32, LR: Double
# ---------- perceptron: C# ----------
    // reset & setup
    if (reset || perceptron == null)
    {
      count = 0;
      trainingData = GenerateTrainingData(nData);
      perceptron = new Perceptron(trainingData[0].inputs.Length, LR);
      inferences = new List<int>();
    }

    // simulation

    if (go)
    {
      // train Perceptron one point at a time (for animation)
      perceptron.Train(trainingData[count].inputs, trainingData[count].label);
      count = (count + 1) % trainingData.Length;

      // make inferences
      inferences.Clear();
      for (int i = 0; i < count; i++)
        inferences.Add(perceptron.FeedForward(trainingData[i].inputs));

      Component.ExpireSolution(true);
    }

    // output
    line = new Line(-50, Function(-50), 0, 50, Function(50), 0);
    Perceptron_line = perceptron.ToLine(-50, 50);
    Weights = perceptron.weights;
    inf = inferences;
    error = perceptron.error;

    List<GH_Point> points = new List<GH_Point>();
    for (int i = 0; i < count; i++)
    {
      points.Add(new GH_Point(new Point3d(trainingData[i].inputs[0], trainingData[i].inputs[1], 0)));
    }

    Points = points;
# ---------- perceptron: C# additional code ----------
  Perceptron perceptron;
  TrainingData[] trainingData;
  int count;
  List<int> inferences;

  public double Function(double x)
  {
    return 2 * x + 1;
  }

  public TrainingData[] GenerateTrainingData(int nData)
  {
    Random rnd = new Random(DateTime.Now.Millisecond);
    TrainingData[] trainingData = new TrainingData[nData];
    // make training points
    for (int i = 0; i < trainingData.Length; i++)
    {
      Point2d point = new Point2d(rnd.NextDouble() * 100 - 50, rnd.NextDouble() * 100 - 50);
      int label = 1;
      if (point.Y < Function(point.X)) label = -1;
      trainingData[i] = new TrainingData(point.X, point.Y, label);
    }

    return trainingData;
  }

  public class Perceptron
  {
    public double[] weights;
    public double learningRate;
    public double error;
    Random rnd;

    public Perceptron(int nWeights, double learningRate)
    {
      weights = new double[nWeights];
      this.learningRate = learningRate;
      rnd = new Random();

      // initialize with random weights
      for (int i = 0; i < nWeights; i++)
        weights[i] = rnd.NextDouble() * 2 - 1;
    }

    public int FeedForward(double[] inputs)
    {
      double sum = 0;
      for (int i = 0; i < weights.Length; i++)
        sum += inputs[i] * weights[i];

      return Activate(sum);
    }

    public int Activate(double sum)
    {
      if (sum > 0) return 1;
      else return 0;
    }

    public void Train(double[] inputs, int label)
    {
      int prediction = FeedForward(inputs);
      error = label - prediction;
      for (int i = 0; i < weights.Length; i++)
        weights[i] += error * inputs[i] * learningRate;
    }

    public Line ToLine(double x0, double x1)
    {
      // Formula is weights[0]*x + weights[1]*y + weights[2] = 0
      return new Line(x0, -(x0 * weights[0] + weights[2]) / weights[1], 0, x1, -(x1 * weights[0] + weights[2]) / weights[1], 0);
    }
  }

  public class TrainingData
  {
    public double[] inputs;
    public int label;

    public TrainingData(double x, double y, int label)
    {
      inputs = new double[3];
      inputs[0] = x;
      inputs[1] = y;
      inputs[2] = 1; // bias

      this.label = label;
    }
  }
# ---------- end perceptron ----------
# Perceptron
# 
# Coding of the original perceptron invented by McCulloch & Pitts in 1943 and built by Frank Rosenblatt in 1958
# 
# code by Alessio Erioli, adapted from Dan Shiffman's version in The Nature of Code
# 
# v 0.1
# © a3 2023 / Creative Commons Attribution-Non Commercial-ShareAlike 4.0 International License
# https://en.wikipedia.org/wiki/Perceptron
# 
# https://natureofcode.com/book/chapter-10-neural-networks/
scriptpar = ScriptParasite(Enable=Toggle(False), Folder=concat)

previewlw = CustomPreviewLineweights(Geometry=rectangle.Rectangle, Shader=ColourSwatch(SwatchColor=RGB(0, 0, 0)), Absolute=False)
panel_2 = Panel(perceptron.Weights)
panel_3 = Panel(""".5
2""")
panel_4 = Panel("""red
blue""")
dash = DashPattern(Curve=perceptron.line, Pattern=panel_3)  # -> Dashes, Gaps
item = ListItem(List=panel_4, Index=perceptron.inf, Wrap=True)

# ----
# Perceptron display
number_slider_2 = Slider(0.164, range=0..0.5)
pt = Point(Point(80, -30, 0))
pt_2 = Point(Point(80, 30, 0))
pt_3 = Point(Point(80, 0, 0))
merge = Merge(Data1=pt_2, Data2=pt_3, Data3=pt)
pt_4 = Point(Point(120, 0, 0))
subtraction = Subtraction(A="1", B=number_slider_2)
ln = Line(StartPoint=merge, EndPoint=pt_4)
cir = Circle(Plane=[merge, pt_4], Radius=Slider(5.09, range=1..10))
dom = ConstructDomain(DomainStart=number_slider_2, DomainEnd=subtraction)
subcrv = SubCurve(BaseCurve=reparameterize(ln), Domain=dom)
item_2 = ListItem(List=perceptron.inf, Index="-1", Wrap=True)
item_3 = ListItem(List=item, Index="-1", Wrap=True)
curvepoint = PointOnCurve(subcrv, parameter=0.5)
panel_5 = Panel("""x
y
b""")
tag = TextTag3D(Location=pt_4, Text=item_2, Size="5", Colour=item_3, Justification=5)
tag_2 = TextTag3D(Location=curvepoint, Text=panel_2, Size="2.5", Colour=ColourSwatch(SwatchColor=RGB(255, 0, 225)), Justification=8)
tag_3 = TextTag3D(Location=merge, Text=panel_5, Size="2.5", Colour=ColourSwatch(SwatchColor=RGB(0, 0, 0)), Justification=5)
previewlw_2 = CustomPreviewLineweights(Geometry=[subcrv, cir], Shader=ColourSwatch(SwatchColor=RGB(46, 46, 46)), Absolute=False)

previewlw_3 = CustomPreviewLineweights(Geometry=dash.Dashes, Shader=ColourSwatch(SwatchColor=RGB(46, 46, 46)), Thickness="3", Absolute=False)
previewlw_4 = CustomPreviewLineweights(Geometry=perceptron.Perceptron_line, Shader=ColourSwatch(SwatchColor=RGB(255, 212, 0)), Thickness="3", Absolute=False)
rec = DataRecorder(perceptron.error, DataLimit=-10, RecordData=False)
dots = DotDisplay(Point=perceptron.Points, Colour=item, Size="0.5")
graph = QuickGraph(rec, SortOrder=0)
bar_graph = BarGraph(rec, BarColor=RGB(255, 0, 90))
