# Grasshopper definition first scripts.gh (Grasshopper 1.0.7)
# Copyright: Co-de-iT

# dist=sqrt (dx^2 + dy^2)
number_slider = Slider(-1.057, range=-10..10)
# try to make a component that makes the average of two points
# try to make a component that draws a line between two points
number_slider_2 = Slider(0.275, range=-10..10)
pt = Point(Point(0, 0, 0))
pt_2 = Point(Point(1.57104488, 0, -0.2301642486))
c_script = CSharpScript(x=number_slider, y=Slider(1.658, range=-10..10), z=number_slider_2)  # -> out, P; inputs x: Double, y: Double, z: Double
# ---------- c_script: C# ----------
    Point3d point;
    
    point = new Point3d(x, y, z);

    
    P = point;
# ---------- end c_script ----------
c_script_2 = CSharpScript(A=c_script.P, B=pt_2)  # -> out, d, L, avg; inputs A: Point3d, B: Point3d
# ---------- c_script_2: C# ----------
    d = A.DistanceTo(B);
    L = new Line(A, B);
    avg = (A + B) / 2;
# ---------- end c_script_2 ----------
c_script_3 = CSharpScript(x=Slider(6.795, range=0..10), y=Slider(7.479, range=0..10))  # -> out, sum, diff; inputs x: Double, y: Double
# ---------- c_script_3: C# ----------
    // My first statement - single line comment
    /*
    Mutli-line
    comment
    */
    //    int a;
    //    string b;
    Print("Hello World!");
    sum = SumOfTwoNumbers(x, y);
    diff = DifOfTwoNumbers(x, y);
# ---------- c_script_3: C# additional code ----------
  double SumOfTwoNumbers(double a, double b)
  {
    double c = a + b;
    return c;
  }

  double DifOfTwoNumbers(double a, double b)
  {
    return a - b;
  }
  
  // operators + - / * %
  
  bool IsNumberEven(int num)
  {
    // conditional statement
    // comparison operators: == < <= > >=
    // boolean operators: ! && ||
    
    //    if (num % 2 == 0)
    //    {
    //      return true;
    //    }
    //    else
    //    {
    //      return false;
    //    }
    
    return num % 2 == 0;
  }
# ---------- end c_script_3 ----------
ln = Line()
# <title>
# 
# <description>
# 
# code by Alessio Erioli
# 
# v 0.1
# © a3 2023 / Creative Commons Attribution-Non Commercial-ShareAlike 4.0 International License
pline = PolyLine(Closed=False)
panel = Panel(c_script_2.d)
panel_2 = Panel(c_script_3.out)
panel_3 = Panel(c_script_3.sum)
panel_4 = Panel(c_script_3.diff)
