# Grasshopper definition second script.gh (Grasshopper 1.0.7)
# Copyright: Co-de-iT

pt = Point(Point(-0.1261810608, 0.3102082266, 0))
X = UnitX(Factor=1)
number_slider = Slider(0.327, range=0..1)
reset = Button()
go = BooleanToggle(False)

go_2 = BooleanToggle(False)
reset_2 = Button()
trigger = Trigger(Interval=1, TimerInterval=5, Target=c_script)  # disabled
c_script = CSharpScript(reset=Button())  # -> out, A; inputs reset: Boolean
# ---------- c_script: C# ----------
    if (reset) 
    {
      i = 0;
    }
    else
    {
      i++;
    }
    A = i;
# ---------- c_script: C# additional code ----------
  int i;
# ---------- end c_script ----------
c_script_2 = CSharpScript(reset=reset_2, go=go_2)  # -> out, A; inputs reset: Boolean, go: Boolean
# ---------- c_script_2: C# ----------
    if (reset)
    {
      i = 0;
    }
    else
    {
      if (go)
      {
        i++;
        Component.ExpireSolution(true);
      }
    }
    A = i;
# ---------- c_script_2: C# additional code ----------
  int i;
# ---------- end c_script_2 ----------
panel = Panel(c_script.A)
panel_2 = Panel(c_script_2.A)

c_script_3 = CSharpScript(reset=reset, go=go, P=pt, V=X, rad=number_slider)  # -> out, V, Pos, Vel, r; inputs reset: Boolean, go: Boolean, P: Point3d, V: Vector3d, rad: Double
# ---------- c_script_3: C# ----------
    // reset
    if(reset || v == null)
    {
      v = new Vehicle(P, V, rad); // instantiation
    }

    // simulate

    //for(int i = 0; i < 10; i++)
    if(go)
    {
      v.Move();
      Component.ExpireSolution(true);
    }

    _V = v;
    Pos = v.position;
    Vel = v.velocity;
    r = v.radius;
# ---------- c_script_3: C# additional code ----------
  Vehicle v; // declaration

  public class Vehicle
  {
    // fields
    public Point3d position;
    public Vector3d velocity;
    public double radius;
    Random rnd;

    // constructors
    public Vehicle()
    {
      position = Point3d.Origin;  // new Point3d();
      velocity = Vector3d.XAxis;
      radius = 1;
    }

    public Vehicle(Point3d p, Vector3d v, double r)
    {
      position = p;
      velocity = v;
      radius = r;
      rnd = new Random();
    }

    // methods
    public void Move()
    {
      //p = p + v; // this doesn't work!!!
      //position = position + velocity;
      //                    random -1 <-> 1      *     maxAngle
      double angle = ((rnd.NextDouble()-0.5)* 2) * (0.25 * Math.PI);
      velocity.Rotate(angle, Vector3d.ZAxis);
      position += velocity; // -=  *= /=
    }
  }
# ---------- end c_script_3 ----------
# <title>
# 
# <description>
# 
# code by Alessio Erioli
# 
# v 0.1
panel_3 = Panel(c_script_3.out)
cir = Circle(Plane=pt, Radius=number_slider)
vdisex = VectorDisplayEx(Point=pt, Vector=X, Colour=RGB(0, 0, 0), Width=2)
cir_2 = Circle(Plane=c_script_3.Pos, Radius=c_script_3.r)
# © a3 2023 / Creative Commons Attribution-Non Commercial-ShareAlike 4.0 International License
vdisex_2 = VectorDisplayEx(Point=c_script_3.Pos, Vector=c_script_3.Vel, Colour=RGB(0, 0, 0), Width=2)
