# Grasshopper definition JitterBug.gh (Grasshopper 1.0.7)
# Copyright: Co-de-iT
# plug-ins: ScriptParasite, froGH

f_ghfilepath = GHFilePathInfo()  # -> FileName, FilePath
concat = Concatenate(FragmentA=f_ghfilepath.FilePath, FragmentB="scripts\")
number_slider = Slider(100, range=10..1000)
X = XSize(Domain(-1, 1))

go = BooleanToggle(False)
reset = Button()
trigger = Trigger(Interval=1, TimerInterval=5, Target=c_script)  # disabled
c_script = CSharpScript(reset=Button())  # -> out, A; inputs reset: Boolean
# ---------- c_script: C# ----------
    if (reset) 
    {
      i = 0;
    }
    else
    {
      i++;
    }
    A = i;
# ---------- c_script: C# additional code ----------
  int i;
# ---------- end c_script ----------
c_script_2 = CSharpScript(reset=reset, go=go)  # -> out, A; inputs reset: Boolean, go: Boolean
# ---------- c_script_2: C# ----------
    if (reset)
    {
      i = 0;
    }
    else
    {
      if (go)
      {
        i++;
        Component.ExpireSolution(true);
      }
    }
    A = i;
# ---------- c_script_2: C# additional code ----------
  int i;
# ---------- end c_script_2 ----------
panel = Panel(c_script.A)
panel_2 = Panel(c_script_2.A)

rectangle = Rectangle(Plane=PlaneXY(0, 0, 0), XSize=X, YSize=X, Radius=0)  # -> Rectangle, Length
pop2d = Populate2D(Region={Plane=PlaneXY(0, 0, 0), Size=Domain2(u=0..20, v=0..10)}, Count=number_slider, Seed=1)
pop2d_2 = Populate2D(Region=rectangle.Rectangle, Count=number_slider, Seed="2")
unit = UnitVector(Vector=pop2d_2)
# <title>
# 
# <description>
# 
# code by Alessio Erioli
# 
# v 0.1
# © a3 2023 / Creative Commons Attribution-Non Commercial-ShareAlike 4.0 International License
reset_2 = Button()
X_2 = UnitX(Factor=1)
go_2 = BooleanToggle(False)

scriptpar = ScriptParasite(Enable=Toggle(False), Folder=concat)
jitterbug = CSharpScript(reset=reset_2, go=go_2, nV=number_slider, P=pop2d, V=unit, rad=Slider(1, range=0..1))  # -> out, Pos, Vel, r, T; inputs reset: Boolean, go: Boolean, nV: Int32, P: list of Point3d, V: list of Vector3d, rad: Double
# ---------- jitterbug: C# ----------
    // ---------------------------------------- 00 reset & initialize
    if (reset || myVehicleSimulation == null)
    {
      myVehicleSimulation = new VehicleSimulation(P, V);
      //myVehicleSimulation = new VehicleSimulation(nV, P, V, rad);
    }

    // ---------------------------------------- 01 simulate
    if (go)
    {
      myVehicleSimulation.Update();
      Component.ExpireSolution(true);
    }

    // ---------------------------------------- output
    List<Point3d> out_pos = new List<Point3d>();
    List<Vector3d> out_vel = new List<Vector3d>();
    List<double> out_rad = new List<double>();
    DataTree<Point3d> trails = new DataTree<Point3d>();

    int count = 0;
    foreach (Vehicle v in myVehicleSimulation.vehicles)
    {
      out_pos.Add(v.position);
      out_vel.Add(v.velocity);
      out_rad.Add(v.radius);
      trails.AddRange(v.trail, new GH_Path(count));
      count++;
    }

    //_V = myVehicles;
    Pos = out_pos;
    Vel = out_vel;
    r = out_rad;
    T = trails;
# ---------- jitterbug: C# additional code ----------
  // global variables
  VehicleSimulation myVehicleSimulation;
  //List<Vehicle> myVehicles;

  // simulation classes
  public class VehicleSimulation
  {
    public List<Vehicle> vehicles;

    public VehicleSimulation(int nVehicles, Point3d P, Vector3d V, double rad)
    {
      //. initialize list of vehicles and useful variables
      vehicles = new List<Vehicle>();
      Random rnd = new Random();
      //. loop for nVeichles iterations
      for (int i = 0; i < nVehicles; i++)
      {
        //   . compute velocity
        Vector3d vel = V;
        vel.Unitize();
        //       . random rotation of V
        vel.Rotate(rnd.NextDouble() * Math.PI * 2, new Vector3d(0, 0, 1));
        //   . compute random radius
        double radius = rad * rnd.NextDouble() + 0.1;
        //   . construct vehicle from P, velocity, rad
        Vehicle v = new Vehicle(P, vel, radius, i); // instantiation
                                                    //   . add to list of vehicles
        vehicles.Add(v);
      }
    }

    public VehicleSimulation(List<Point3d> P, List<Vector3d> V)
    {
      int nPoints = P.Count;
      // make the rest of this constructor

      // P[i] -iest item in the List P
      // V[i] -iest item in the List V
      //. initialize list of vehicles and useful variables
      vehicles = new List<Vehicle>();
      Random rnd = new Random();

      //. loop for nPoints iterations
      for (int i = 0; i < nPoints; i++)
      {
        //   . compute velocity
        Vector3d vel = V[i];
        vel.Unitize();
        //       . random rotation of V
        vel.Rotate(rnd.NextDouble() * Math.PI * 2, new Vector3d(0, 0, 1));
        vel *= rnd.NextDouble() * 3 + 0.01;
        //   . compute random radius
        double radius = rnd.NextDouble() + 0.1;
        //   . construct vehicle from P, velocity, rad
        Vehicle v = new Vehicle(P[i], vel, radius, i);
        //   . add to list of vehicles
        vehicles.Add(v);
      }
    }

    public void Update()
    {
      foreach (Vehicle v in vehicles) v.Update();
    }
  }

  public class Vehicle
  {
    // fields
    public Point3d position;
    public Vector3d velocity;
    public double radius;
    public List<Point3d> trail;
    Random rnd;

    // constructors

    public Vehicle(Point3d p, Vector3d v, double r, int seed)
    {
      position = p;
      velocity = v;
      radius = r;
      rnd = new Random(seed);
      trail = new List<Point3d>();
      trail.Add(position);
    }

    // methods
    public void ComputeVelocity()
    {
      //                    random -1 <-> 1      *     maxAngle
      double angle = ((rnd.NextDouble() - 0.5) * 2) * (0.25 * Math.PI);
      velocity.Rotate(angle, Vector3d.ZAxis);
    }

    public void Update()
    {
      ComputeVelocity();
      position += velocity;
      TrailUpate();
    }

    public void TrailUpate()
    {
      trail.Add(position);
    }
  }
# ---------- end jitterbug ----------

# ---- group: by VAL or by REF
c_script_3 = CSharpScript()  # -> out, A, B
# ---------- c_script_3: C# ----------
    // primitive types and Structs are passed by VALUE
    Point3d a,b;
    a = new Point3d(0, 1, 0);
    b = a;
    b.X += 5;
    A = a.X; // 0
    
    // classes are passed by REFERENCE
    MyPoint c,d;
    c = new MyPoint(0, 1, 0);
    d = new MyPoint(0, 1, 0);
    d.X += 5;
    B = c.X; // 5
# ---------- c_script_3: C# additional code ----------
  public class MyPoint
  {
    public double X;
    public double Y;
    public double Z;
    
    public MyPoint(double X, double Y, double Z)
    {
      this.X = X;
      this.Y = Y;
      this.Z = Z;
    }
  
  }
# ---------- end c_script_3 ----------
panel_3 = Panel(c_script_3.A)
panel_4 = Panel(c_script_3.B)

# ----
pline = PolyLine(Vertices=jitterbug.T, Closed=False)
cir = Circle(Plane=jitterbug.Pos, Radius=jitterbug.r)
vdisex = VectorDisplayEx(Point=jitterbug.Pos, Vector=jitterbug.Vel, Colour=RGB(0, 0, 0), Width=2)
panel_5 = Panel(jitterbug.out)
