# Grasshopper definition Agent System.gh (Grasshopper 1.0.7)
# Copyright: Co-de-iT
# plug-ins: ScriptParasite, froGH

f_ghfilepath = GHFilePathInfo()  # -> FileName, FilePath
concat = Concatenate(FragmentA=f_ghfilepath.FilePath, FragmentB="scripts\")
number_slider = Slider(100, range=10..1000)

# ---- group: Vectors
X = XSize(Domain(-1, 1))
rectangle = Rectangle(Plane=PlaneXY(0, 0, 0), XSize=X, YSize=X, Radius=0)  # -> Rectangle, Length
pop2d = Populate2D(Region=rectangle.Rectangle, Count=number_slider, Seed="2")
unit = UnitVector(Vector=pop2d)

# ----
rectangle_2 = Rectangle(Plane=PlaneXY(0, 0, 0), XSize="30", YSize="30", Radius=0)  # -> Rectangle, Length
# <title>
# 
# <description>
# 
# code by Alessio Erioli
# 
# v 0.1
# © a3 2023 / Creative Commons Attribution-Non Commercial-ShareAlike 4.0 International License
crv = Curve(rectangle_2.Rectangle)

# ---- group: Points
pop2d_2 = Populate2D(Region=rectangle_2.Rectangle, Count=number_slider, Seed=1)

# ----
scriptpar = ScriptParasite(Enable=Toggle(False), Folder=concat)
agentsystem = CSharpScript(reset=Button(), go=Toggle(False), P=pop2d_2, V=unit, nR=Slider(3, range=0..10), coS=Slider(0.25, range=0..10))  # -> out, oP, oV, oT; inputs reset: Boolean, go: Boolean, P: list of Point3d, V: list of Vector3d, nR: Double, coS: Double
# ---------- agentsystem: C# ----------
    // initialization
    if (reset || agSys == null)
      agSys = new AgentSystem(P, V);

    // simulation
    if (go)
    {
      // update live variables
      agSys.NeighborhoodRadius = nR;
      agSys.CohesionStrength = coS;

      // update simulation
      agSys.Update();
      Component.ExpireSolution(true);
    }


    // output
    List<Point3d> outPos = new List<Point3d>();
    List<Vector3d> outVel = new List<Vector3d>();

    foreach (Agent agent in agSys.agents)
    {
      outPos.Add(agent.position);
      outVel.Add(agent.velocity);
    }

    oP = outPos;
    oV = outVel;
# ---------- agentsystem: C# additional code ----------
  // global variables
  AgentSystem agSys;

  // simulation classes
  public class AgentSystem
  {
    // fields
    public List<Agent> agents;
    public double NeighborhoodRadius;
    public double CohesionStrength;

    public double BoundingBoxSize;
    public double ContainmentStrength;

    // constructor
    public AgentSystem(List<Point3d> points, List<Vector3d> vectors)
    {
      agents = new List<Agent>();

      for (int i = 0; i < points.Count; i++)
      {
        //Agent ag = new Agent(points[i], vectors[i]);
        //ag.agentSystem = this;
        Agent ag = new Agent(points[i], vectors[i], this);

        agents.Add(ag);
      }

      BoundingBoxSize = 30.0;
      ContainmentStrength = 1.0;
    }

    // methods
    public void Update()
    {
      // compute agent
      foreach (Agent agent in agents)
      {
        agent.ComputeFlocking(FindNeighbours(agent));
      }

      // update velocity and position
      foreach (Agent agent in agents)
        agent.UpdateVelocityAndPosition();
    }

    public List<Agent> FindNeighbours(Agent ag)
    {
      List<Agent> neighbours = new List<Agent>();

      foreach (Agent neighbour in agents)
      {
        if (neighbour != ag && ag.position.DistanceTo(neighbour.position) < NeighborhoodRadius)
        {
          neighbours.Add(neighbour);
        }
      }

      return neighbours;
    }

  }

  public class Agent
  {
    // fields
    public Point3d position;
    public Vector3d velocity;
    public Vector3d desired;
    public AgentSystem agentSystem;
    public double maxSpeed;

    // constructor
    public Agent(Point3d position, Vector3d velocity)
    {
      this.position = position;
      this.velocity = velocity;
      maxSpeed = 0.3;
    }

    public Agent(Point3d pos, Vector3d vel, AgentSystem agentSystem) : this(pos, vel)
    {
      this.agentSystem = agentSystem;
    }

    // methods
    public void UpdateVelocityAndPosition()
    {
      // steering
      velocity = 0.97 * velocity + 0.03 * desired;
      
      if (velocity.Length > maxSpeed)
      {
        velocity.Unitize();
        velocity *= maxSpeed;
      }

      // update position
      position += velocity;
    }

    public void ComputeFlocking(List<Agent> neighbours)
    {
      ResetDesired();
      Containment();
      Flocking(neighbours);
    }

    public void Flocking(List<Agent> neighbours)
    {
      if (neighbours.Count == 0) return;

      // cohesion

      // alignment

      // separation
    }

    public void Containment()
    {
      if (position.X < 0.0)
        desired += new Vector3d(-position.X, 0, 0);
      else if (position.X > agentSystem.BoundingBoxSize)
        desired += new Vector3d(agentSystem.BoundingBoxSize - position.X, 0, 0);

      if (position.Y < 0.0)
        desired += new Vector3d(0,-position.Y, 0);
      else if (position.Y > agentSystem.BoundingBoxSize)
        desired += new Vector3d(0, agentSystem.BoundingBoxSize - position.Y, 0);

      // make for Z direction


      desired *= agentSystem.ContainmentStrength;
    }

    public void ResetDesired()
    {
      desired = velocity;
    }
  }
# ---------- end agentsystem ----------

vdisex = VectorDisplayEx(Point=agentsystem.oP, Vector=agentsystem.oV, Colour=RGB(0, 0, 0), Width=2)
