# Grasshopper definition Agent System.gh (Grasshopper 1.0.7)
# Copyright: Co-de-iT
# plug-ins: ScriptParasite, froGH, Human

f_ghfilepath = GHFilePathInfo()  # -> FileName, FilePath
concat = Concatenate(FragmentA=f_ghfilepath.FilePath, FragmentB="scripts\")
number_slider = Slider(1000, range=10..2000)

# ---- group: Vectors
X = XSize(Domain(-1, 1))
rectangle = Rectangle(Plane=PlaneXY(0, 0, 0), XSize=X, YSize=X, Radius=0)  # -> Rectangle, Length
panel = Panel("2")
pop2d = Populate2D(Region=rectangle.Rectangle, Count=number_slider, Seed=panel)
unit = UnitVector(Vector=pop2d)

# ----
rectangle_2 = Rectangle(Plane=PlaneXY(0, 0, 0), XSize="30", YSize="30", Radius=0)  # -> Rectangle, Length
crv = Curve(rectangle_2.Rectangle)

# ---- group: Points
pop2d_2 = Populate2D(Region=rectangle_2.Rectangle, Count=number_slider, Seed=1)

# ----
box = DomainBox(Base=PlaneXY(0, 0, 0), X="30", Y="30", Z="30")
# <title>
# 
# <description>
# 
# code by Alessio Erioli
# 
# v 0.1
# © a3 2023 / Creative Commons Attribution-Non Commercial-ShareAlike 4.0 International License
edges = BrepEdges(Brep=box)  # -> Naked, Interior, NonManifold
pop3d = Populate3D(Region=box, Count=number_slider, Seed=1)
box_2 = DomainBox(Base=PlaneXY(0, 0, 0), X=X, Y=X, Z=X)
pop3d_2 = Populate3D(Region=box_2, Count=number_slider, Seed=panel)
number_slider_2 = Slider(2.832, range=0..10)
list = ValueList({"Serial": 0, "Parallel": 1, "RTree": 2}, selected="RTree")
unit_2 = UnitVector(Vector=pop3d_2)
multiplication = Multiplication(A=number_slider_2, B=Slider(0.3, range=0..1))

scriptpar = ScriptParasite(Enable=Toggle(False), Folder=concat)
agentsystem = CSharpScript(
    reset=Button(),
    go=Toggle(False),
    uT=list,
    P=pop2d_2,
    V=unit,
    nR=number_slider_2,
    aoV=Slider(64.398, range=0..180),
    coS=Slider(0.856, range=0..10),
    alS=Slider(9, range=0..10),
    seS=Slider(0.096, range=0..1),
    seR=multiplication)  # -> out, oP, oV, oT; inputs reset: Boolean, go: Boolean, uT: Int32, P: list of Point3d, V: list of Vector3d, nR: Double, aoV: Double, coS: Double, alS: Double, seS: Double, seR: Double
# ---------- agentsystem: C# usings ----------
using System.Threading.Tasks;
# ---------- agentsystem: C# ----------
    // initialization
    if (reset || agSys == null)
      agSys = new AgentSystem(P, V);

    // simulation
    if (go)
    {
      // update live variables
      agSys.NeighborhoodRadius = nR;
      agSys.CohesionStrength = coS;
      agSys.AlignmentStrength = alS;
      agSys.SeparationStrength = seS;
      agSys.SeparationRadius = seR;
      agSys.AngleOfVision = ToRadians(aoV);

      // update simulation
      switch (uT)
      {
        case 0:
          agSys.Update();
          // other instructions....
          break;
        case 1:
          agSys.UpdateParallel();
          break;
        case 2:
          agSys.UpdateRTree();
          break;
        default:
          goto case 0;
      }

      Component.ExpireSolution(true);
    }


    // output
    //List<Point3d> outPos = new List<Point3d>();
    //List<Vector3d> outVel = new List<Vector3d>();
    //List<Polyline> outTrails = new List<Polyline>();

    //foreach (Agent agent in agSys.agents)
    //{
    //  outPos.Add(agent.position);
    //  outVel.Add(agent.velocity);
    //  outTrails.Add(agent.trail);
    //}

    agSys.Output();

    oP = agSys.outputValues.positions; //outPos;
    oV = agSys.outputValues.velocities; //outVel;
    oT = agSys.outputValues.trails; //outTrails;
# ---------- agentsystem: C# additional code ----------
  // global variables
  AgentSystem agSys;

  // helper classes
  public struct OutputValues
  {
    public GH_Point[] positions;
    public GH_Vector[] velocities;
    public Polyline[] trails;

    public OutputValues(int agentsCount)
    {
      positions = new GH_Point[agentsCount];
      velocities = new GH_Vector[agentsCount];
      trails = new Polyline[agentsCount];
    }
  }

  // simulation classes
  public class AgentSystem
  {
    // fields
    public List<Agent> agents;
    public double NeighborhoodRadius;
    public double CohesionStrength;

    public double BoundingBoxSize;
    public double ContainmentStrength;
    public double AlignmentStrength;
    public double SeparationStrength;
    public double SeparationRadius;
    public double AngleOfVision;
    public int iterationCount;
    public OutputValues outputValues;

    // constructor
    public AgentSystem(List<Point3d> points, List<Vector3d> vectors)
    {
      agents = new List<Agent>();

      for (int i = 0; i < points.Count; i++)
      {
        //Agent ag = new Agent(points[i], vectors[i]);
        //ag.agentSystem = this;
        Agent ag = new Agent(points[i], vectors[i], this);

        agents.Add(ag);
      }

      BoundingBoxSize = 30.0;
      ContainmentStrength = 1.0;
      iterationCount = 0;
    }

    // methods

    public void UpdateRTree()
    {
      // build RTree
      RTree pointsRTree = new RTree();
      for (int i = 0; i < agents.Count; i++)
        pointsRTree.Insert(agents[i].position, i);

      // find neighbours & call compute
      foreach (Agent agent in agents)
      {
        List<Agent> neighbours = new List<Agent>();

        // query RTree
        pointsRTree.Search(new Sphere(agent.position, NeighborhoodRadius), (sender, args) =>
        {
          Agent neighbour = agents[args.Id];
          // if it's not me
          if (neighbour != agent)
          {
            Vector3d toNeighbour = neighbour.position - agent.position;
            if (Vector3d.VectorAngle(toNeighbour, agent.velocity) < AngleOfVision)
              neighbours.Add(neighbour);
          }
        });

        // compute agent
        agent.ComputeFlocking(neighbours);
      }

      // update velocity and position
      Parallel.ForEach(agents, agent =>
      {
        agent.UpdateVelocityAndPosition();
      });

      iterationCount++;
    }

    public void Update()
    {
      // compute agent
      foreach (Agent agent in agents)
      {
        agent.ComputeFlocking(FindNeighbours(agent));
      }

      // update velocity and position
      foreach (Agent agent in agents)
        agent.UpdateVelocityAndPosition();

      iterationCount++;
    }

    public void UpdateParallel()
    {
      // compute agent
      //foreach (Agent agent in agents)
      // Parallel.ForEach(collection, method);
      Parallel.ForEach(agents, agent =>
      {
        //agent.ComputeFlocking(FindNeighbours(agent));
        agent.ComputeStigmergy();
      });

      // update velocity and position
      //foreach (Agent agent in agents)
      Parallel.ForEach(agents, agent =>
      {
        agent.UpdateVelocityAndPosition();
      });

      iterationCount++;
    }

    public List<Agent> FindNeighbours(Agent ag)
    {
      List<Agent> neighbours = new List<Agent>();

      foreach (Agent neighbour in agents)
      {
        Vector3d toNeighbour = neighbour.position - ag.position;
        if (neighbour != ag
          && ag.position.DistanceTo(neighbour.position) < NeighborhoodRadius
          && Vector3d.VectorAngle(ag.velocity, toNeighbour) < AngleOfVision)
        {
          neighbours.Add(neighbour);
        }
      }

      return neighbours;
    }

    public void Output()
    {
      outputValues = new OutputValues(agents.Count);

      //for(int i=0; i< agents.Count; i++)
      Parallel.For(0, agents.Count, i => 
      {
        outputValues.positions[i] = new GH_Point(agents[i].position);
        outputValues.velocities[i] = new GH_Vector(agents[i].velocity);
        outputValues.trails[i] = agents[i].trail;
      });
    }

  }

  public class Agent
  {
    // fields
    public Point3d position;
    public Vector3d velocity;
    public Vector3d desired;
    public AgentSystem agentSystem;
    public double maxSpeed;
    public Polyline trail;
    public int trailLength;
    public int trailFrequency;
    //List<Point3d> pointList;
    //Point3d[] pointArray;
    // constructor
    public Agent(Point3d position, Vector3d velocity)
    {
      //pointList = new List<Point3d>();
      //pointArray = new Point3d[] { new Point3d(0,2,3), new Point3d()};

      this.position = position;
      this.velocity = velocity;
      //desired = velocity;
      maxSpeed = 0.3;
      trail = new Polyline(new Point3d[] { this.position });
      trailLength = 10;
      trailFrequency = 4;
    }

    public Agent(Point3d pos, Vector3d vel, AgentSystem agentSystem) : this(pos, vel)
    {
      this.agentSystem = agentSystem;
    }

    // methods
    public void UpdateVelocityAndPosition()
    {
      // steering
      velocity = 0.97 * velocity + 0.03 * desired;

      if (velocity.Length > maxSpeed)
      {
        velocity.Unitize();
        velocity *= maxSpeed;
      }

      // update position
      position += velocity;

      // update trail
      if (agentSystem.iterationCount % trailFrequency == 0)
        trail.Add(position);

      if (trail.Count > trailLength)
        trail.RemoveAt(0);

      // remove from list
      //for (int i = List.Count - 1; i >= 0; i--)
      //{
      //  check if elemnt is removed
      // list.RemoveAt(i);
      //}
    }

    public void SeekTarget(Point3d target, double intensity)
    {
      Vector3d seek = target - position;
      desired += seek * intensity;
    }

    public Point3d FindCLosestTrailPoint()
    {
      Point3d trailpoint, closest = position;
      double dist, minDist = agentSystem.NeighborhoodRadius;
      int value, maxValue = -1;

      foreach (Agent other in agentSystem.agents)
      {
        if (other == this) continue;

        value = other.trail.ClosestIndex(position + velocity * 3.0);
        trailpoint = other.trail[value];

        Vector3d toTrailPoint = trailpoint - position;
        dist = toTrailPoint.Length;
        if (dist < minDist
          && Vector3d.VectorAngle(toTrailPoint, velocity) < agentSystem.AngleOfVision)
          if (value > maxValue)
          {
            closest = trailpoint;
            minDist = dist;
            maxValue = value;
          }
      }
      return closest;
    }

    public void ComputeStigmergy()
    {
      ResetDesired();
      Containment();
      SeekTarget(FindCLosestTrailPoint(), 10.0);
    }

    public void ComputeFlocking(List<Agent> neighbours)
    {
      ResetDesired();
      Containment();
      Flocking(neighbours);
    }

    public void Flocking(List<Agent> neighbours)
    {
      if (neighbours.Count == 0) return;

      // cohesion
      // find neighbours average position
      Point3d average = new Point3d();

      foreach (Agent neighbour in neighbours)
        average += neighbour.position;

      average /= neighbours.Count;

      // go there
      Vector3d cohesion = average - position;

      // update desired
      desired += cohesion * agentSystem.CohesionStrength;

      // alignment
      Vector3d alignment = Vector3d.Zero;

      foreach (Agent neighbour in neighbours)
        alignment += neighbour.velocity;

      alignment /= neighbours.Count;

      desired += alignment * agentSystem.AlignmentStrength;

      // separation
      Vector3d separation = Vector3d.Zero;

      foreach (Agent neighbour in neighbours)
      {
        // check if neighbour is in separation radius
        double distanceToNeighbour = neighbour.position.DistanceTo(position);
        if (distanceToNeighbour < agentSystem.SeparationRadius)
        {
          Vector3d getaway = position - neighbour.position;
          getaway /= (getaway.Length * distanceToNeighbour);
          separation += getaway;
        }
        // update desired
        desired += separation * agentSystem.SeparationStrength;
      }
    }

    public void Containment()
    {
      if (position.X < 0.0)
        desired += new Vector3d(-position.X, 0, 0);
      else if (position.X > agentSystem.BoundingBoxSize)
        desired += new Vector3d(agentSystem.BoundingBoxSize - position.X, 0, 0);

      if (position.Y < 0.0)
        desired += new Vector3d(0, -position.Y, 0);
      else if (position.Y > agentSystem.BoundingBoxSize)
        desired += new Vector3d(0, agentSystem.BoundingBoxSize - position.Y, 0);

      // make for Z direction


      //desired *= agentSystem.ContainmentStrength;
    }

    public void ResetDesired()
    {
      desired = velocity;
    }
  }

  public double ToRadians(double degrees)
  {
    return degrees * Math.PI / 180.0;
  }
# ---------- end agentsystem ----------

multiplication_2 = Multiplication(A=agentsystem.oV, B=Slider(1, range=1..10))
crv_2 = Curve(agentsystem.oT)
vdisex = VectorDisplayEx(Point=agentsystem.oP, Vector=multiplication_2, Colour=RGB(0, 0, 0), Width=2)
previewlw = CustomPreviewLineweights(Geometry=crv_2, Shader=ColourSwatch(SwatchColor=RGB(92, 178, 84)), Absolute=False)
