# Grasshopper definition KangarooExample.gh (Grasshopper 1.0.7)
# Copyright: Co-de-iT
# plug-ins: ScriptParasite, froGH

f_ghfilepath = GHFilePathInfo()  # -> FileName, FilePath
concat = Concatenate(FragmentA=f_ghfilepath.FilePath, FragmentB="scrpits\")
# <title>
# 
# <description>
# 
# code by Alessio Erioli
# 
# v 0.1
# © a3 2023 / Creative Commons Attribution-Non Commercial-ShareAlike 4.0 International License
toggle = BooleanToggle(False)

c_script = CSharpScript(Reference="C:\Program Files\Rhino 7\Plug-ins\Grasshopper\Components\KangarooSolver.dll")  # -> out, A
# ---------- c_script: C# usings ----------
using KangarooSolver;
# ---------- end c_script ----------
scriptpar = ScriptParasite(Enable=toggle, Folder=concat)
