# Grasshopper definition Perceptron.gh (Grasshopper 1.0.7)
# Copyright: Co-de-iT
# plug-ins: ScriptParasite, froGH, Human

f_ghfilepath = GHFilePathInfo()  # -> FileName, FilePath
# <title>
# 
# <description>
# 
# code by Alessio Erioli
# 
# v 0.1
# © a3 2023 / Creative Commons Attribution-Non Commercial-ShareAlike 4.0 International License
toggle = BooleanToggle(False)
concat = Concatenate(FragmentA=f_ghfilepath.FilePath, FragmentB="scripts")

c_script = CSharpScript(reset=Button(), go=Toggle(False), nData="150", LR=Slider(0.01, range=0..1))  # -> out, Points, inf, line, Perc_line, Weights; inputs reset: Boolean, go: Boolean, nData: Int32, LR: Double
# ---------- c_script: C# ----------
    // . . . . 0.initialize
    if (reset || pTron == null)
    {
      count = 0;
      training = GenerateTrainingData(nData);
      pTron = new Perceptron(training[0].inputs.Length, LR);
      inferences = new List<int>();
    }

    // . . . . 1.update

    // update live variables


    if (go)
    {
      // update simulation
      pTron.Train(training[count].inputs, training[count].answer);
      count = (count + 1) % training.Length;

      // make inferences
      inferences.Clear();
      for (int i = 0; i < count; i++)
        inferences.Add(pTron.FeedForward(training[i].inputs));

      Component.ExpireSolution(true);
    }

    // . . . . 2.output
    line = new Line(-50, Function(-50), 0, 50, Function(50), 0);
    Perc_line = pTron.ToLine(-50, 50);
    Weights = pTron.weights;
    inf = inferences;

    List<GH_Point> points = new List<GH_Point>();
    for (int i = 0; i < count; i++)
      points.Add(new GH_Point(
        new Point3d(training[i].inputs[0],training[i].inputs[1], 0)));
    
    Points = points;
# ---------- c_script: C# additional code ----------
  // global variables
  Perceptron pTron;
  TrainingData[] training;
  int count;
  List<int> inferences;

  // simulation classes
  public class Perceptron
  {
    public double[] weights;
    public double learningRate;
    public double error;
    Random rnd;

    public Perceptron(int nWeights, double learningRate)
    {
      weights = new double[nWeights];
      this.learningRate = learningRate;
      rnd = new Random();
      // initialize random weights
      for (int i = 0; i < nWeights; i++)
        weights[i] = rnd.NextDouble() * 2 - 1;
    }

    public int Activate(double sum)
    {
      if (sum > 0) return 1;
      else return 0;
    }

    public int FeedForward(double[] inputs)
    {
      double sum = 0;
      for (int i = 0; i < weights.Length; i++)
        sum += inputs[i] * weights[i];

      return Activate(sum);
    }

    public void Train(double[] inputs, int answer)
    {
      int guess = FeedForward(inputs);
      error = answer - guess;
      for(int i=0; i< weights.Length; i++)
        weights[i] += error * inputs[i] * learningRate;
    }

    public Line ToLine(double x0, double x1)
    {
      return new Line(x0, -(x0 * weights[0] + weights[2]) / (weights[1]+0.000001), 0,
        x1, -(x1 * weights[0] + weights[2]) / (weights[1] + 0.000001), 0);
    }
  }

  // helper classes

  public class TrainingData
  {
    public double[] inputs;
    public int answer;

    public TrainingData(double x, double y, int a)
    {
      inputs = new double[3];

      inputs[0] = x;
      inputs[1] = y;
      inputs[2] = 1; // bias

      answer = a;
    }
  }

  // helper methods

  public TrainingData[] GenerateTrainingData(int nData)
  {
    Random rnd = new Random(DateTime.Now.Millisecond);
    TrainingData[] training = new TrainingData[nData];
    // make training points
    for (int i = 0; i < training.Length; i++)
    {
      double x = rnd.NextDouble() * 100 - 50;
      double y = rnd.NextDouble() * 100 - 50;
      int answer = 1;
      if (y < Function(x)) answer = -1;
      training[i] = new TrainingData(x, y, answer);
    }

    return training;
  }

  public double Function(double x)
  {
    return 2 * x + 1;
  }
# ---------- end c_script ----------
scriptpar = ScriptParasite(Enable=toggle, Folder=concat)

lng = ListLength(List=c_script.Points)
panel = Panel("""black
red""")
previewlw = CustomPreviewLineweights(Geometry=c_script.Perc_line, Shader=ColourSwatch(SwatchColor=RGB(255, 8, 0)), Thickness="3", Absolute=False)
previewlw_2 = CustomPreviewLineweights(Geometry=c_script.line, Shader=ColourSwatch(SwatchColor=RGB(0, 0, 0)), Thickness="2", Absolute=False)
panel_2 = Panel(lng)
item = ListItem(List=panel, Index=c_script.inf, Wrap=True)
panel_3 = Panel("0.5")
dots = DotDisplay(Point=c_script.Points, Colour=item, Size=1)
