# Grasshopper definition Values-references-properties.gh (Grasshopper 1.0.7)
# Copyright: Co-de-iT

c_script = CSharpScript()  # -> out, A
# ---------- c_script: C# ----------
    int a = 40;
    int b = a;
    a += 5;

    Point3d p1 = new Point3d(0, 0, 0);
    Point3d p2 = p1;
    p1 += new Point3d(0, 1, 2);

    myPoint mp1 = new myPoint(new Point3d(0, 0, 0));
    myPoint mp2 = mp1; // by reference
    myPoint mp3 = new myPoint(mp1.point); //
    mp1.point += new Point3d(0, 1, 2);
    mp2.point += new Point3d(3, 0, 0);
    mp3.point += new Point3d(3, 0, 0);

    Point3d p4 = mp3.point; // by value or by reference?
    p4 += new Point3d(0, 0, 5);


    A = mp3.point;
# ---------- c_script: C# additional code ----------
  class myPoint
  {
    public Point3d point;
    double intensity;
    // intensity is declared as property
    // a property has implied get and set methods
    // to control its access and value
    // see https://learn.microsoft.com/en-us/dotnet/csharp/programming-guide/classes-and-structs/properties
    public double Intensity
    {
      get{
        return intensity;
      }
      set{
        if (value < 0)
          intensity = 0;
        else
          intensity = value;
      }
    }
    public int Index
    { get; private set;}

    public myPoint(Point3d _p)
    {
      point = _p;
    }

    //    public double GetIntensity()
    //    {
    //      return intensity;
    //    }
    //
    //    public void SetIntensity(double inputInt)
    //    {
    //      if (inputInt <0)
    //        intensity = 0;
    //      else
    //        intensity = inputInt;
    //    }
  }
# ---------- end c_script ----------
panel = Panel(c_script.A)
panel_2 = Panel(c_script.out)
